# Dynamo graph 03_Cotas generales.dyn (Dynamo 4.0.2.3852)
# Cotas generales por assembly: ancho y largo total en la planta, altura total y spot elevations (sup/inf) en el corte. Usa caras extremas de los elementos del assembly como referencias.

procesar_todos_los_assemblies = BoolSelector(true)  # graph input
filtro_por_nombre_si_todos_false = StringInput("")  # graph input
separacion_cota_general_mm_por = IntegerSlider(20, range=5..30 step 1)  # "Separacion cota general (mm) - por FUERA de la cadena"; graph input
filtro_material_cortes_vacio = StringInput("")  # "Filtro material cortes (vacio = todos)"; graph input
py_cotas_generales_spot = Python(IN[0]=procesar_todos_los_assemblies, IN[1]=filtro_por_nombre_si_todos_false, IN[2]=separacion_cota_general_mm_por, IN[3]=filtro_material_cortes_vacio)  # "PY | Cotas generales + spot elevations"; PythonNet3
# ---------- py_cotas_generales_spot.python (411 lines) ----------
# 03_Cotas generales - Cotas generales por assembly
# planta: ancho y largo total | cortes A y B: altura total + spot elevation superior +
# Multi-Tag del elemento mas bajo del assembly (solo si es de la familia C-CapaCimiento)
# Revit 2027 / Dynamo 4 / CPython3
# IN[0] = procesar todos los assemblies (bool)
# IN[1] = filtro por nombre si IN[0] es False (parcial, comas)
# IN[2] = separacion de la cota respecto al assembly, en mm de papel
# IN[3] = ya no se usa (antes: filtro de material para los cortes); se reemplazo por un
#         filtro de categoria (Structural Foundation), mas confiable. Se mantiene el
#         input conectado por compatibilidad pero el graph lo ignora.
#
# Regla de negocio del Multi-Tag (2026-07-09): en ambos cortes (A y B), se etiqueta el
# elemento REAL mas bajo de todo el assembly (a cualquier profundidad de anidamiento,
# no solo los miembros de primer nivel) con un Multi-Category Tag de la familia
# "C-MultiCat" tipo "Descripcion+Comentario" - pero SOLO si ese elemento mas bajo
# pertenece a la familia "C-CapaCimiento" (cualquier tipo). No todos los assemblies
# tienen esta capa (a veces el elemento mas bajo es otra cosa) - en ese caso no se
# taguea nada, sin error.

import clr
clr.AddReference('RevitAPI')
clr.AddReference('RevitServices')
from Autodesk.Revit.DB import (FilteredElementCollector, AssemblyInstance, View,
                               Options, ViewDetailLevel, Solid, GeometryInstance,
                               PlanarFace, ReferenceArray, Line, XYZ, UV,
                               Dimension, Element, BuiltInCategory, ElementId,
                               IndependentTag, Reference, TagOrientation, FamilyInstance)
from RevitServices.Persistence import DocumentManager
from RevitServices.Transactions import TransactionManager

doc = DocumentManager.Instance.CurrentDBDocument

process_all = bool(IN[0])
filter_text = (IN[1] or '').strip()
offset_mm = float(IN[2])
CAT_FOUNDATION = ElementId(BuiltInCategory.OST_StructuralFoundation)
NOMBRE_FAMILIA_TAG_CAPA = 'C-MultiCat'
NOMBRE_TIPO_TAG_CAPA = 'Descripcion+Comentario'
NOMBRE_FAMILIA_CAPA_CIMIENTO = 'C-CapaCimiento'

log = []
# contrato de nombres de la rutina de ARMADURAS (ver 00): este graph acota las
# vistas de ARMADURAS; las de Formas (FN-1001 a secas) nunca matchean.
SUFIJO_ARMADURAS = ' - ARMADURA'
SUFIJO_CORTE = SUFIJO_ARMADURAS + ' - CORTE A'
SUFIJO_CORTE_B = SUFIJO_ARMADURAS + ' - CORTE B'
PARALELO = 0.99   # tolerancia: la normal de la cara debe ser paralela a la direccion medida
MIN_DIST = 0.01   # pies: separacion minima entre las dos referencias de una cota

def elem_name(e):
    try:
        return e.Name
    except Exception:
        return Element.Name.__get__(e)

# --- assemblies objetivo (unicos por tipo, igual que 02) ---
by_type = {}
for ai in FilteredElementCollector(doc).OfClass(AssemblyInstance):
    by_type.setdefault(ai.AssemblyTypeName, []).append(ai)

if process_all:
    targets = sorted(by_type.keys())
else:
    tokens = [t.strip().lower() for t in filter_text.split(',') if t.strip()]
    if tokens:
        targets = [n for n in sorted(by_type.keys())
                   if any(tok in n.lower() for tok in tokens)]
    else:
        targets = []
        log.append('ERROR: \"Todos\" esta en False y el filtro esta vacio.')

views = {}
for v in FilteredElementCollector(doc).OfClass(View):
    if not v.IsTemplate:
        views[elem_name(v)] = v

def add_solid_faces(out, s, trf, cat_id, el_id):
    for f in s.Faces:
        if isinstance(f, PlanarFace) and f.Reference is not None:
            n = f.FaceNormal
            buv = f.GetBoundingBox()
            uv = UV((buv.Min.U + buv.Max.U) / 2.0, (buv.Min.V + buv.Max.V) / 2.0)
            p = f.Evaluate(uv)
            if trf is not None:
                n = trf.OfVector(n)
                p = trf.OfPoint(p)
            out.append((f.Reference, n, p, cat_id, el_id))

def collect_faces(ai):
    # caras planas con referencia de todos los miembros del assembly
    # (para familias: geometria de simbolo, cuyas referencias si son acotables)
    out = []
    opt = Options()
    opt.ComputeReferences = True
    opt.DetailLevel = ViewDetailLevel.Fine
    for mid in ai.GetMemberIds():
        el = doc.GetElement(mid)
        geo = el.get_Geometry(opt)
        if geo is None:
            continue
        cat_id = el.Category.Id if el.Category is not None else None
        for g in geo:
            if isinstance(g, Solid) and g.Volume > 1e-9:
                add_solid_faces(out, g, None, cat_id, mid.Value)
            elif isinstance(g, GeometryInstance):
                trf = g.Transform
                for sg in g.GetSymbolGeometry():
                    if isinstance(sg, Solid) and sg.Volume > 1e-9:
                        add_solid_faces(out, sg, trf, cat_id, mid.Value)
    return out

def extremes(faces, d):
    # las dos caras mas extremas cuya normal es paralela a d
    cands = [(ref, p) for ref, n, p, c, e in faces if abs(n.DotProduct(d)) > PARALELO]
    if len(cands) < 2:
        return None
    lo = min(cands, key=lambda c: c[1].DotProduct(d))
    hi = max(cands, key=lambda c: c[1].DotProduct(d))
    if hi[1].DotProduct(d) - lo[1].DotProduct(d) < MIN_DIST:
        return None
    return lo, hi

def element_top_faces(faces, d, excluir_id=None):
    # para cada elemento (agrupado por su ElementId), la cara PROPIA mas alta en la
    # direccion d (con normal paralela a d) - sirve para armar una cadena con un
    # segmento por elemento en vez de una sola cota de extremo a extremo.
    # excluir_id: si se pasa, ese elemento no genera su propio segmento (2026-07-13,
    # capa de cimiento con Multi-Tag - ver comentario en make_dim_chain).
    por_elemento = {}
    for ref, n, p, c, el_id in faces:
        if excluir_id is not None and el_id == excluir_id:
            continue
        if abs(n.DotProduct(d)) <= PARALELO:
            continue
        val = p.DotProduct(d)
        actual = por_elemento.get(el_id)
        if actual is None or val > actual[1]:
            por_elemento[el_id] = (ref, val, p)
    return list(por_elemento.values())

def top_face_de(faces, d, el_id):
    # cara PROPIA mas alta (en direccion d) de UN elemento puntual - para arrancar
    # la cadena desde ahi en vez de desde el borde inferior absoluto (ver uso en
    # make_dim_chain).
    mejor = None
    for ref, n, p, c, e in faces:
        if e != el_id or abs(n.DotProduct(d)) <= PARALELO:
            continue
        val = p.DotProduct(d)
        if mejor is None or val > mejor[1]:
            mejor = (ref, val, p)
    return mejor

def dim_line(d, perp, perp_value, p_lo, p_hi):
    # linea paralela a d, desplazada a perp_value sobre el eje perp
    c = p_lo.Add(p_hi).Multiply(0.5)
    base = c.Add(perp.Multiply(perp_value - c.DotProduct(perp)))
    q1 = base.Add(d.Multiply(p_lo.DotProduct(d) - base.DotProduct(d)))
    q2 = base.Add(d.Multiply(p_hi.DotProduct(d) - base.DotProduct(d)))
    return Line.CreateBound(q1, q2)

def has_dims(v):
    return FilteredElementCollector(doc, v.Id).OfClass(Dimension).GetElementCount() > 0

def has_tags(v):
    return (FilteredElementCollector(doc, v.Id)
            .OfCategory(BuiltInCategory.OST_MultiCategoryTags)
            .OfClass(IndependentTag).GetElementCount() > 0)

def hojas_recursivas(ai):
    # todas las hojas (FamilyInstance sin sub-componentes propios) del assembly, a
    # cualquier profundidad de anidamiento - mismo patron que 06_Tabla de assemblies.
    # Hace falta esto (en vez de solo ai.GetMemberIds()) porque collect_faces()
    # atribuye la geometria de simbolos anidados al miembro de PRIMER NIVEL, no al
    # elemento real que la contiene - para identificar la familia real del elemento
    # mas bajo hay que llegar hasta la hoja.
    vistos = set()
    hojas = []
    stack = list(ai.GetMemberIds())
    while stack:
        eid = stack.pop()
        if eid.Value in vistos:
            continue
        vistos.add(eid.Value)
        el = doc.GetElement(eid)
        if el is None or not isinstance(el, FamilyInstance):
            continue
        subs = []
        try:
            subs = list(el.GetSubComponentIds())
        except Exception:
            pass
        if subs:
            stack.extend(subs)
        else:
            hojas.append(el)
    return hojas

def elemento_mas_bajo(hojas):
    # la hoja cuyo bounding box llega mas abajo (Z minimo mas bajo de todas)
    mejor, mejor_z = None, None
    for el in hojas:
        try:
            bb = el.get_BoundingBox(None)
        except Exception:
            bb = None
        if bb is None:
            continue
        if mejor_z is None or bb.Min.Z < mejor_z:
            mejor_z, mejor = bb.Min.Z, el
    return mejor

def proj_range(faces, d):
    vals = [p.DotProduct(d) for ref, n, p, c, e in faces]
    return (min(vals), max(vals))

def make_dim(view, faces, d, perp, perp_value, etiqueta, tname):
    ext = extremes(faces, d)
    if ext is None:
        log.append('AVISO {}: sin caras perpendiculares para la cota de {}.'.format(tname, etiqueta))
        return 0
    (lo_ref, p_lo), (hi_ref, p_hi) = ext
    ra = ReferenceArray()
    ra.Append(lo_ref)
    ra.Append(hi_ref)
    line = dim_line(d, perp, perp_value, p_lo, p_hi)
    doc.Create.NewDimension(view, line, ra)
    log.append('OK {}: cota de {} en \"{}\".'.format(tname, etiqueta, elem_name(view)))
    return 1

def make_dim_chain(view, faces, d, perp, perp_value, etiqueta, tname, excluir_id=None):
    # cadena con UN segmento por elemento: del borde inferior absoluto a la cara
    # propia mas alta de cada elemento, en orden ascendente (en vez de una sola
    # cota de extremo a extremo). Con un solo elemento da el mismo resultado que
    # make_dim (una cota, dos referencias).
    # excluir_id (2026-07-13): el elemento mas bajo del assembly, cuando ya lleva
    # el Multi-Tag de capa de cimiento (ver elem_bajo mas abajo), no genera su
    # propio segmento en la cadena - queda tageado pero no acotado por separado.
    # La cadena arranca desde la cara SUPERIOR de ESE elemento (no desde el borde
    # inferior absoluto del assembly): su espesor queda completamente fuera de la
    # cadena, en vez de fusionarse con el segmento de arriba.
    ext = extremes(faces, d)
    if ext is None:
        log.append('AVISO {}: sin caras perpendiculares para la cota de {}.'.format(tname, etiqueta))
        return 0
    (lo_ref, p_lo), (hi_ref, p_hi) = ext
    if excluir_id is not None:
        propio = top_face_de(faces, d, excluir_id)
        if propio is not None:
            lo_ref, _val_propio, p_lo = propio
    tops = element_top_faces(faces, d, excluir_id)
    tops.sort(key=lambda t: t[1])
    filtrados = []
    ultimo = None
    for ref, val, p in tops:
        if ultimo is None or val - ultimo > MIN_DIST:
            filtrados.append(ref)
            ultimo = val
    ra = ReferenceArray()
    ra.Append(lo_ref)
    for ref in (filtrados if filtrados else [hi_ref]):
        ra.Append(ref)
    line = dim_line(d, perp, perp_value, p_lo, p_hi)
    doc.Create.NewDimension(view, line, ra)
    log.append('OK {}: cota de {} en \"{}\" ({} segmentos).'.format(tname, etiqueta, elem_name(view), max(1, len(filtrados))))
    return 1

total = 0
TransactionManager.Instance.EnsureInTransaction(doc)

tag_type_capa = None
for t in FilteredElementCollector(doc).OfCategory(BuiltInCategory.OST_MultiCategoryTags).WhereElementIsElementType():
    try:
        if (t.FamilyName.strip().lower() == NOMBRE_FAMILIA_TAG_CAPA.lower()
                and elem_name(t).strip().lower() == NOMBRE_TIPO_TAG_CAPA.lower()):
            tag_type_capa = t
            break
    except Exception:
        continue
if tag_type_capa is None:
    log.append('AVISO: no se encontro el tag "{} : {}" (Multi-Category Tag) para la capa de cimiento; ese tag se omite.'.format(
        NOMBRE_FAMILIA_TAG_CAPA, NOMBRE_TIPO_TAG_CAPA))
    disponibles = list(FilteredElementCollector(doc).OfCategory(BuiltInCategory.OST_MultiCategoryTags).WhereElementIsElementType())
    if disponibles:
        log.append('Tags multicategoria disponibles: ' + ', '.join(sorted('{} : {}'.format(t.FamilyName, elem_name(t)) for t in disponibles)))
elif hasattr(tag_type_capa, 'IsActive') and not tag_type_capa.IsActive:
    tag_type_capa.Activate()

try:
    for tname in targets:
        ai = by_type[tname][0]
        try:
            faces = collect_faces(ai)
            if not faces:
                log.append('ERROR {}: los miembros no exponen geometria con referencias.'.format(tname))
                continue
            # ---------- PLANTA: ancho y largo total ----------
            vplan = views.get(tname + SUFIJO_ARMADURAS)
            if vplan is None:
                log.append('AVISO {}: no existe la vista de planta (corre 00_Vistas de assembly).'.format(tname))
            elif has_dims(vplan):
                log.append('{}: la planta ya tiene cotas, se salta.'.format(tname))
            else:
                rd = vplan.RightDirection
                ud = vplan.UpDirection
                off = offset_mm / 304.8 * vplan.Scale
                u0, u1 = proj_range(faces, ud)
                r0, r1 = proj_range(faces, rd)
                try:
                    # cota de ancho ARRIBA de la planta
                    total += make_dim(vplan, faces, rd, ud, u1 + off, 'ancho', tname)
                except Exception as e:
                    log.append('ERROR {} cota ancho: {}'.format(tname, e))
                try:
                    total += make_dim(vplan, faces, ud, rd, r0 - off, 'largo', tname)
                except Exception as e:
                    log.append('ERROR {} cota largo: {}'.format(tname, e))
            # ---------- CORTES A y B: altura total + spot elevations ----------
            # en los cortes solo se acota Structural Foundation (filtro por categoria del
            # elemento dueño de la cara, no por nombre de material - mas confiable). Si
            # ningun miembro de esa categoria expone caras referenciables, NO se cae a
            # usar toda la geometria del assembly: pernos/planchas/conexiones dan
            # referencias poco confiables (caras delgadas, simbolos anidados) que Revit
            # termina rechazando para Spot Elevation ("Spot Dimensions can generally
            # reference only those references which have valid coordinates in the
            # view") - y a veces incluso para la propia cota, recien al comitear la
            # transaccion al final del script (dialogo "Deleted element: id = -1").
            # Mas vale saltar el corte con un aviso claro que forzar una anotacion
            # fragil que interrumpe al usuario con un dialogo de error de Revit.
            faces_corte = [fx for fx in faces if fx[3] == CAT_FOUNDATION]
            if not faces_corte:
                log.append('AVISO {}: ningun miembro de Structural Foundation con caras referenciables; se omiten la cota de altura y la spot elevation de los cortes (el resto de la geometria - pernos, planchas, conexiones - no da referencias confiables para acotar).'.format(tname))

            # elemento REAL mas bajo del assembly (a cualquier profundidad de anidamiento);
            # solo se taguea si es de la familia C-CapaCimiento (no todos los assemblies
            # tienen esta capa - en ese caso queda en None y no se taguea nada).
            elem_bajo = None
            candidato_bajo = elemento_mas_bajo(hojas_recursivas(ai))
            if candidato_bajo is not None:
                try:
                    fam_nombre = candidato_bajo.Symbol.Family.Name
                except Exception:
                    fam_nombre = ''
                if fam_nombre.strip().lower() == NOMBRE_FAMILIA_CAPA_CIMIENTO.lower():
                    elem_bajo = candidato_bajo

            for suf, nombre_corte in ((SUFIJO_CORTE, 'corte A'), (SUFIJO_CORTE_B, 'corte B')):
                vsec = views.get(tname + suf)
                if vsec is None:
                    log.append('AVISO {}: no existe la vista de {} (corre 00_Vistas de assembly).'.format(tname, nombre_corte))
                    continue
                rd = vsec.RightDirection
                z = XYZ.BasisZ
                off = offset_mm / 304.8 * vsec.Scale
                if has_dims(vsec):
                    log.append('{}: el {} ya tiene cotas, se salta.'.format(tname, nombre_corte))
                elif faces_corte:
                    r0, r1 = proj_range(faces, rd)
                    try:
                        excluir_id = elem_bajo.Id.Value if elem_bajo is not None else None
                        # cadena de altura a la IZQUIERDA del corte (r0 - off; pedido de
                        # los modeladores 2026-07-13, antes iba a la derecha). La spot
                        # elevation superior sigue a la derecha.
                        total += make_dim_chain(vsec, faces_corte, z, rd, r0 - off, 'altura ({})'.format(nombre_corte), tname, excluir_id)
                    except Exception as e:
                        log.append('ERROR {} cota altura {}: {}'.format(tname, nombre_corte, e))
                    ext = extremes(faces_corte, z)
                    if ext is None:
                        log.append('AVISO {}: sin caras horizontales para spot elevations.'.format(tname))
                    else:
                        (lo_ref, p_lo), (hi_ref, p_hi) = ext
                        # solo la spot elevation superior; la inferior ya no se coloca
                        pares = ((hi_ref, p_hi, 1.0, 'superior'),)
                        for ref, pt, dz, tag in pares:
                            try:
                                bend = pt.Add(rd.Multiply(off)).Add(XYZ(0, 0, dz * off))
                                end = bend.Add(rd.Multiply(off))
                                doc.Create.NewSpotElevation(vsec, ref, pt, bend, end, pt, True)
                                total += 1
                                log.append('OK {}: spot elevation {} en {}.'.format(tname, tag, nombre_corte))
                            except Exception as e:
                                log.append('ERROR {} spot elevation {} en {}: {}'.format(tname, tag, nombre_corte, e))

                # --- Multi-Tag del elemento mas bajo del assembly (solo si es C-CapaCimiento) ---
                # independiente de si el corte ya tenia cotas de una corrida anterior.
                if tag_type_capa is not None and elem_bajo is not None:
                    if has_tags(vsec):
                        log.append('{}: el {} ya tiene el tag de capa de cimiento, se salta.'.format(tname, nombre_corte))
                    else:
                        try:
                            bb = elem_bajo.get_BoundingBox(None)
                            # alineado a la mitad del elemento (sin desplazamiento lateral)
                            # y por debajo del assembly completo (Z minimo de TODA la
                            # geometria del assembly, no solo del elemento mas bajo).
                            centro_x = (bb.Min.X + bb.Max.X) / 2.0
                            centro_y = (bb.Min.Y + bb.Max.Y) / 2.0
                            z_min_assembly = proj_range(faces, XYZ.BasisZ)[0]
                            head = XYZ(centro_x, centro_y, z_min_assembly - off * 2.0)
                            IndependentTag.Create(doc, tag_type_capa.Id, vsec.Id, Reference(elem_bajo),
                                                  True, TagOrientation.Horizontal, head)
                            total += 1
                            log.append('OK {}: tag de capa de cimiento en {}.'.format(tname, nombre_corte))
                        except Exception as e:
                            log.append('ERROR {} tag de capa de cimiento en {}: {}'.format(tname, nombre_corte, e))
        except Exception as e:
            log.append('ERROR {}: {}'.format(tname, e))
finally:
    TransactionManager.Instance.TransactionTaskDone()

log.insert(0, 'Anotaciones creadas: {} | assemblies procesados: {}'.format(total, len(targets)))
OUT = log
# ----------------------------------------
log = Watch(py_cotas_generales_spot)  # graph output
