# Dynamo graph 04_Cotas generales.dyn (Dynamo 4.0.2.3852)
# PASO 5 de 6 - Agrega las anotaciones. En la planta: etiquetas de armadura. En los cortes A y B: la anotacion de cada set de barras (cantidad y espaciamiento) y la cadena de cotas de cobertura. Requiere los pasos 2 a 4.

procesar_todos_los_assemblies = BoolSelector(true)  # graph input
filtro_por_nombre_si_todos_false = StringInput("")  # graph input
separacion_cota_general_mm_por = IntegerSlider(-10, range=-50..50 step 1)  # "Separacion cota general (mm) - por FUERA de la cadena"; graph input
filtro_material_cortes_vacio = StringInput("")  # "Filtro material cortes (vacio = todos)"; graph input
sep_tags_corte_al_borde_mm = IntegerSlider(3, range=0..40 step 1)  # graph input
sep_entre_tags_corte_mm = IntegerSlider(8, range=1..40 step 1)  # graph input
py_cotas_generales_spot = Python(IN[0]=procesar_todos_los_assemblies, IN[1]=filtro_por_nombre_si_todos_false, IN[2]=separacion_cota_general_mm_por, IN[3]=filtro_material_cortes_vacio, IN[4]=sep_tags_corte_al_borde_mm, IN[5]=sep_entre_tags_corte_mm)  # "PY | Cotas generales + spot elevations"; PythonNet3
# ---------- py_cotas_generales_spot.python (1725 lines) ----------
# 04_Cotas generales (ARMADURAS) - Anotaciones por assembly
# planta: SOLO tags de Structural Rebar segun Layout Rule (2026-07-14: se quito la cota
# de ancho/largo que heredaba la rutina de Formas - en el plano de armaduras esa cota
# no va) | cortes A y B: altura total (ya no se tagea la
# capa de cimiento ni se coloca spot elevation - ambos se eliminaron el 2026-07-21,
# pedido de Javier: aparecian tags/anotaciones no deseados en los cortes)
#
# Regla de negocio de los tags de armadura (2026-07-14): en la planta (todavia NO en los
# cortes), cada Structural Rebar del assembly (miembro directo o hospedado, ver
# rebar_del_assembly) se etiqueta con un Rebar Tag (categoria OST_RebarTags, NO Multi-Category) de la familia
# "C_EtiquetaArmaduras", eligiendo el TIPO segun el parametro de instancia de la barra
# cuyo nombre contiene "layout" (busqueda parcial, ver leer_layout_rule - el accessor
# shape-driven, Rebar.GetShapeDrivenAccessor(), resulto ser de SOLO ESCRITURA, sin
# ningun getter, asi que el valor se lee del parametro real via AsValueString(); si
# ninguna barra tiene un parametro asi, el log vuelca todos los parametros de esa
# barra para diagnosticar): Layout = "Single" -> tipo
# "RecuentoDoble_Corto"; Layout = "Number with Spacing" -> tipo "RecuentoSimple_Corto"
# (ver TIPO_TAG_POR_LAYOUT). EXCEPCION - BARRAS DE AJUSTE (2026-07-30, Javier): una barra
# de Layout "Single" cuyo Partition sea PPL-SUP o PPL-INF es una "barra de ajuste" y en
# PLANTA lleva el tipo "RecuentoDoble+Dim_S/Linea_Largo" en vez del RecuentoDoble_Corto que
# le tocaria por Layout (ver tipo_tag_planta). Otros valores de Layout (Fixed Number,
# Maximum Spacing, Minimum Clear Spacing) no tienen regla definida todavia: la barra queda
# sin etiquetar y el log avisa. Idempotente por barra (no por vista): una vez
# tageada, no se vuelve a tocar aunque el resto de la planta (cotas) se reprocese.
# Revit 2027 / Dynamo 4 / CPython3
# IN[0] = procesar todos los assemblies (bool)
# IN[1] = filtro por nombre si IN[0] es False (parcial, comas)
# IN[2] = separacion de la cota respecto al assembly, en mm de papel
# IN[3] = ya no se usa (antes: filtro de material para los cortes, luego reemplazado
#         por un filtro de categoria Structural Foundation para la cota de altura -
#         esa cota se elimino por completo el 2026-07-21). Se mantiene el input
#         conectado por compatibilidad pero el graph lo ignora.
# IN[4] = Multi-Rebar Annotations en cortes: separacion de la primera anotacion al borde
#         del assembly, en mm de papel (pegado al assembly; default 3).
# IN[5] = Multi-Rebar Annotations en cortes: paso a la izquierda entre anotaciones que
#         chocan verticalmente, en mm de papel (default 8).
#
# Multi-Tag de capa de cimiento, ELIMINADO (2026-07-09 a 2026-07-21): existio un
# Multi-Category Tag ("C-MultiCat" tipo "Descripcion+Comentario") sobre el elemento
# REAL mas bajo del assembly cuando era de la familia "C-CapaCimiento" - se saco por
# completo (pedido de Javier: aparecia un tag no deseado en los cortes).
#
# Cota de altura en cadena, ELIMINADA (2026-07-13 a 2026-07-21, pedido de Javier: eran
# unas cotas azules que no deberian aparecer, senalando la zapata y el pedestal):
# existio una cadena de Dimension en los cortes (make_dim_chain, un segmento por
# elemento Structural Foundation) - se saco por completo junto con todo lo que solo
# ella usaba (elem_bajo/candidato_bajo, hojas_recursivas, elemento_mas_bajo, has_dims,
# make_dim_chain, element_top_faces, top_face_de, proj_range, CAT_FOUNDATION,
# NOMBRE_FAMILIA_CAPA_CIMIENTO). El corte ahora solo recibe la Multi-Rebar Annotation.

import clr
clr.AddReference('RevitAPI')
clr.AddReference('RevitServices')
from Autodesk.Revit.DB import (FilteredElementCollector, AssemblyInstance, View,
                               Options, ViewDetailLevel, Solid, GeometryInstance,
                               PlanarFace, ReferenceArray, Line, XYZ, UV,
                               Element, BuiltInCategory, ElementId,
                               IndependentTag, Reference, TagOrientation, FamilyInstance,
                               TextNote, TextNoteOptions, TextNoteType,
                               TextNoteLeaderTypes, HorizontalTextAlignment, ElementTypeGroup,
                               MultiReferenceAnnotation, MultiReferenceAnnotationType,
                               MultiReferenceAnnotationOptions, BuiltInParameter, StorageType)
from Autodesk.Revit.DB.Structure import (Rebar, RebarInSystem, RebarContainer, RebarHostData,
                                         RebarPresentationMode, MultiplanarOption, RebarShape,
                                         RebarStyle)
from RevitServices.Persistence import DocumentManager
from RevitServices.Transactions import TransactionManager
from System.Collections.Generic import List

doc = DocumentManager.Instance.CurrentDBDocument

process_all = bool(IN[0])
filter_text = (IN[1] or '').strip()
offset_mm = float(IN[2])
# sliders del Player para el escalonado de las Multi-Rebar Annotations en los CORTES
# (2026-07-21, pedido de Javier: regular la separacion sin editar el codigo). mm de
# papel. IN[4] = separacion de la primera anotacion al borde del assembly (pegado);
# IN[5] = paso a la izquierda entre anotaciones que chocan. Ver bloque de cortes.
clearance_tags_corte_mm = float(IN[4])
paso_tags_corte_mm = float(IN[5])
NOMBRE_FAMILIA_TAG_CAPA = 'C-MultiCat'
NOMBRE_FAMILIA_TAG_ARM = 'C_EtiquetaArmaduras'
TIPO_TAG_POR_LAYOUT = {
    'single': 'RecuentoDoble_Corto',
    'number with spacing': 'RecuentoSimple_Corto',
}
# --- BARRAS DE AJUSTE (termino de Javier, 2026-07-30) ---
# Son las barras PPL-SUP / PPL-INF modeladas SUELTAS (Layout Rule "Single", o sea que NO
# forman parte de un set multibarra): el refuerzo que se agrega para ajustar el canastillo,
# no la malla misma. En PLANTA llevan un tipo de tag PROPIO, distinto del que les tocaria
# solo por Layout: RecuentoDoble+Dim_S/Linea_Largo en vez de RecuentoDoble_Corto. La regla
# vive en tipo_tag_planta() y aplica SOLO a la planta - los cortes no usan esta tabla (usan
# Multi-Rebar Annotation, y ademas exigen Layout "Number with Spacing", asi que una barra de
# ajuste nunca llega ahi).
# OJO: hoy solo llegan a taguearse las PPL-INF, porque PARTITIONS_TAGEABLES deja fuera a las
# PPL-SUP. Se listan las dos igual para que la regla siga siendo correcta si ese filtro
# cambia; el mismo par de Partition define la nota (SUP.-INF.) del Schedule Mark en el 00.
NOMBRE_TIPO_TAG_AJUSTE = 'RecuentoDoble+Dim_S/Linea_Largo'
PARTITIONS_BARRA_AJUSTE = set(['PPL-SUP', 'PPL-INF'])
PARTITIONS_TAGEABLES = set(['PPL-INF', 'SEC-LAT'])  # 2026-07-20: renombrados desde C-INF/C-LAT (C-SUP -> PPL-SUP nunca estuvo en este set)
# Multi-Rebar Annotation (2026-07-15): ademas del Rebar Tag de arriba (coexisten sobre
# la misma barra), anota las mismas barras que 00 dejo en modo primera-y-ultima
# (Rebar.SetPresentationMode con RebarPresentationMode.FirstLast, ver
# mostrar_primera_ultima en 00) y que pasan el mismo filtro de Partition
# (PARTITIONS_TAGEABLES). No es un Rebar Tag de familia cargable: la categoria es
# OST_MultiReferenceAnnotations (Multi-Rebar Annotations en la UI), clase
# MultiReferenceAnnotationType, sin FamilyName - se busca por Name directo.
NOMBRE_TIPO_MULTIREBAR = 'RecuentoDoble+Info_S/Linea_Largo'
# Tipo distinto para estribos/amarras en los CORTES (2026-07-21, pedido de Javier):
# si la barra es RebarShape.RebarStyle == StirrupTie, la Multi-Rebar Annotation del
# corte usa este tipo en vez de NOMBRE_TIPO_MULTIREBAR. Solo aplica en cortes (ver
# es_estribo_stirrup_tie y el bloque de Multi-Rebar Annotation en cortes) - la planta
# no se toco, sigue usando siempre NOMBRE_TIPO_MULTIREBAR.
NOMBRE_TIPO_MULTIREBAR_ESTRIBO = 'RecuentoSimple+Info_S/Linea_Largo'
# Escalonado de las Multi-Rebar Annotations en los CORTES (2026-07-21, pedido de
# Javier: se montaban unas sobre otras y sobre la zapata). La separacion base al borde
# (clearance) y el paso entre anotaciones que chocan son SLIDERS del Player
# (clearance_tags_corte_mm = IN[4], paso_tags_corte_mm = IN[5], ver mas arriba) para
# poder regularlos sin editar el codigo. Solo queda constante el colchon vertical de
# deteccion de choques (mm de PAPEL, se convierte con la escala de cada corte): cuanto
# se suma al rango vertical de cada barra para decidir si dos anotaciones chocan (cubre
# el largo del texto, que sobresale del rango de la barra). Si dos tags a alturas
# distintas igual se pisan por el texto, subir este valor.
MARGEN_MULTIREBAR_CORTE_MM = 10.0
# margen HORIZONTAL para el escalonado del empuje hacia ARRIBA (2026-07-21, mismo
# pedido: sets horizontales -zapata- se amontonaban a la misma altura cuando habia
# varios en el mismo corte). Mas grande que el vertical porque tiene que cubrir el
# ANCHO del texto (mas largo que su alto), no solo un colchon de linea.
MARGEN_HORIZONTAL_MULTIREBAR_CORTE_MM = 60.0
# tags de familias en la planta (ex-05, integrado 2026-07-15): misma familia de tag
# C-MultiCat que se usaba para el tag de capa de cimiento en los cortes (eliminado
# 2026-07-21), tipo 'Modelo' (el default que usaba 05).
NOMBRE_TIPO_TAG_FAMILIAS = 'Modelo'
NOMBRE_FAMILIA_PEDESTAL_PURA = 'C-Pedestal'

log = []
# contrato de nombres de la rutina de ARMADURAS (ver 00): este graph acota las
# vistas de ARMADURAS; las de Formas (FN-1001 a secas) nunca matchean.
SUFIJO_ARMADURAS = ' - ARMADURA'
SUFIJO_CORTE = SUFIJO_ARMADURAS + ' - CORTE A'
SUFIJO_CORTE_B = SUFIJO_ARMADURAS + ' - CORTE B'
PARALELO = 0.99   # tolerancia: la normal de la cara debe ser paralela a la direccion medida
MIN_DIST = 0.01   # pies: separacion minima entre las dos referencias de una cota

def elem_name(e):
    try:
        return e.Name
    except Exception:
        return Element.Name.__get__(e)

def rebar_del_assembly(ai):
    # mismo patron que armaduras_del_assembly() de 00: barras miembro directo del
    # assembly + barras hospedadas (RebarHostData). RebarHostData se chequea en
    # CUALQUIER instancia del assembly, a cualquier profundidad de anidamiento
    # (instancias_recursivas, 2026-07-20) -- no solo en los miembros de PRIMER NIVEL:
    # si el elemento que hospeda la barra es un sub-componente anidado 2+ niveles
    # adentro de un miembro de primer nivel (mismo caso que el fix de collect_faces),
    # RebarHostData.GetRebarHostData() sobre el miembro de primer nivel daba None y
    # la planta quedaba sin ningun Rebar Tag ni Multi-Rebar Annotation.
    barras = {}
    def agregar(r):
        try:
            barras[r.Id.Value] = r
        except Exception:
            pass
    for mid in ai.GetMemberIds():
        el = doc.GetElement(mid)
        if isinstance(el, (Rebar, RebarInSystem, RebarContainer)):
            agregar(el)
    for el in instancias_recursivas(ai):
        try:
            hd = RebarHostData.GetRebarHostData(el)
        except Exception:
            hd = None
        if hd is None:
            continue
        try:
            for r in hd.GetRebarsInHost():
                agregar(r)
        except Exception:
            pass
    return list(barras.values())

def instancias_recursivas(ai):
    # todas las FamilyInstance del assembly a cualquier profundidad de anidamiento
    # (a diferencia de hojas_recursivas, incluye tambien los contenedores, no solo las
    # hojas) - mismo patron que usa 01 para lo mismo.
    vistos = set()
    resultado = []
    stack = list(ai.GetMemberIds())
    while stack:
        eid = stack.pop()
        if eid.Value in vistos:
            continue
        vistos.add(eid.Value)
        el = doc.GetElement(eid)
        if el is None or not isinstance(el, FamilyInstance):
            continue
        resultado.append(el)
        try:
            stack.extend(list(el.GetSubComponentIds()))
        except Exception:
            pass
    return resultado

def es_familia_pedestal(nombre_familia):
    # 2026-07-15: no todos los pedestales son la familia \"C-Pedestal\" pura - hay
    # familias COMBINADAS fundacion+pedestal en una sola pieza (\"C-Fundacion+Pedestal\",
    # \"C-Fundacion+2-Pedestal\"). Match por substring, mismo criterio que 01.
    try:
        return 'pedestal' in nombre_familia.strip().lower()
    except Exception:
        return False

def pedestales_del_assembly(ai):
    # todas las instancias del assembly cuya familia matchea es_familia_pedestal - se
    # usa SOLO para CONTAR cuantos pedestales tiene el assembly.
    resultado = []
    for el in instancias_recursivas(ai):
        try:
            fam = el.Symbol.Family.Name
        except Exception:
            continue
        if es_familia_pedestal(fam):
            resultado.append(el)
    return resultado

def tipos_pedestal(ai):
    # nombres de TIPO distintos de la familia C-Pedestal PURA en el assembly (match
    # EXACTO de familia, igual que los callouts de pedestal de 00 - las familias
    # combinadas fundacion+pedestal NO cuentan aca: son un solo tipo sin pedestales
    # separables). Distinto de pedestales_del_assembly (substring), que cuenta
    # INSTANCIAS para ocultar barras.
    tipos = set()
    for el in instancias_recursivas(ai):
        try:
            fam = el.Symbol.Family.Name
        except Exception:
            continue
        if fam.strip().lower() == NOMBRE_FAMILIA_PEDESTAL_PURA.lower():
            tipos.add(elem_name(el.Symbol).strip())
    return tipos

def es_barra_de_pedestal(r, pedestal_ids):
    # host de la barra (Rebar.GetHostId) y su cadena de anidamiento
    # (FamilyInstance.SuperComponent): True si el host o algun ancestro ES una de las
    # instancias de pedestal del assembly (pedestal_ids, ver pedestales_del_assembly).
    try:
        host = doc.GetElement(r.GetHostId())
    except Exception:
        return False
    pasos = 0
    while host is not None and pasos < 50:
        try:
            hid = host.Id.Value
        except Exception:
            hid = None
        if hid is not None and hid in pedestal_ids:
            return True
        try:
            host = host.SuperComponent
        except Exception:
            host = None
        pasos += 1
    return False

def resolver_pedestal_de_barra(r, pedestal_ids):
    # mismo recorrido que es_barra_de_pedestal, pero devuelve el ElementId.Value del
    # pedestal encontrado (o None) en vez de True/False - permite saber A CUAL
    # pedestal especifico pertenece la barra, no solo si pertenece a alguno
    # (2026-07-21, usado en el corte para acercar cada Multi-Rebar Annotation al
    # pedestal que le corresponde en vez de amontonarlas todas a la izquierda).
    try:
        host = doc.GetElement(r.GetHostId())
    except Exception:
        return None
    pasos = 0
    while host is not None and pasos < 50:
        try:
            hid = host.Id.Value
        except Exception:
            hid = None
        if hid is not None and hid in pedestal_ids:
            return hid
        try:
            host = host.SuperComponent
        except Exception:
            host = None
        pasos += 1
    return None

def lado_derecho_pedestal_en_corte(pedestal_id, pedestales, vsec):
    # True si el pedestal identificado por pedestal_id queda al lado DERECHO de los
    # demas pedestales del assembly, proyectando el centro de cada uno sobre
    # vsec.RightDirection (sistema local de ESTE corte especifico - cada corte tiene
    # su propio eje). Compara contra el PROMEDIO de todos los pedestales en vez de
    # asumir que son exactamente dos, para no fallar con 3+.
    right_v = vsec.RightDirection
    proyecciones = {}
    for el in pedestales:
        try:
            bb = el.get_BoundingBox(None)
            if bb is None:
                continue
            centro = XYZ((bb.Min.X + bb.Max.X) / 2.0, (bb.Min.Y + bb.Max.Y) / 2.0, (bb.Min.Z + bb.Max.Z) / 2.0)
            proyecciones[el.Id.Value] = centro.DotProduct(right_v)
        except Exception:
            continue
    if pedestal_id not in proyecciones or len(proyecciones) < 2:
        return False
    promedio = sum(proyecciones.values()) / len(proyecciones)
    return proyecciones[pedestal_id] > promedio

def empuje_derecha_corte(centro, direccion, v, off_plan):
    # Mismo criterio geometrico que posicion_afuera_assembly (funcion COMPARTIDA con
    # la planta, no se modifica) pero forzando el empuje hacia la DERECHA - se usa
    # SOLO para barras de un pedestal identificado como "el de la derecha" en un
    # assembly con 2+ pedestales (ver lado_derecho_pedestal_en_corte), para que sus
    # Multi-Rebar Annotation queden cerca de su propio pedestal en vez de
    # amontonarse a la izquierda con el resto del assembly (2026-07-21, pedido de
    # Javier: como dejar mas cerca de los pedestales a las cotas correspondientes).
    perp = v.ViewDirection.CrossProduct(direccion)
    if perp.GetLength() < 1e-6:
        perp = v.RightDirection
    else:
        perp = perp.Normalize()
    right_v = v.RightDirection
    if perp.DotProduct(right_v) < 0:
        perp = perp.Negate()
    bb = v.CropBox
    maxv = None
    for x in (bb.Min.X, bb.Max.X):
        for y in (bb.Min.Y, bb.Max.Y):
            p = bb.Transform.OfPoint(XYZ(x, y, 0.0))
            val = p.DotProduct(perp)
            if maxv is None or val > maxv:
                maxv = val
    val_centro = centro.DotProduct(perp)
    destino = maxv + off_plan
    return centro.Add(perp.Multiply(destino - val_centro)), perp

def leer_layout_rule(r):
    # El accessor shape-driven (RebarShapeDrivenAccessor) resulto ser de SOLO
    # ESCRITURA (2026-07-14): solo tiene SetLayoutAsSingle/SetLayoutAsFixedNumber/etc,
    # ningun getter. El valor real hay que leerlo del parametro de instancia de la
    # barra (busqueda por coincidencia parcial del nombre, no exacta, por si el
    # nombre de definicion no es exactamente "Layout"). Devuelve (texto, None) si
    # funciono, o (None, motivo) si no.
    if not isinstance(r, Rebar):
        return None, 'no es un Rebar individual ({})'.format(type(r).__name__)
    try:
        parametros = list(r.Parameters)
    except Exception as e:
        return None, 'no se pudo leer Parameters: {}'.format(e)
    for p in parametros:
        try:
            nombre = p.Definition.Name
        except Exception:
            continue
        if 'layout' in nombre.lower():
            try:
                valor = p.AsValueString()
            except Exception:
                valor = None
            if valor:
                return valor.strip(), None
    nombres = sorted(set(p.Definition.Name for p in parametros if p.Definition is not None))
    return None, 'no se encontro ningun parametro de Layout; parametros de esta barra: {}'.format(', '.join(nombres))

def leer_partition(r):
    # Regla de negocio 2026-07-15: solo se tagean barras cuyo parametro de instancia
    # \"Partition\" (texto plano, no enum - a diferencia de Layout Rule no hace falta
    # AsValueString) valga \"PPL-INF\" o \"SEC-LAT\" (PARTITIONS_TAGEABLES, renombrados 2026-07-20 desde C-INF/C-LAT). Cualquier otro
    # valor, o sin el parametro, no se tagea.
    try:
        p = r.LookupParameter('Partition')
    except Exception:
        p = None
    if p is None:
        return None
    try:
        valor = p.AsString()
    except Exception:
        valor = None
    return valor.strip() if valor else None

def tipo_tag_planta(layout_txt, partition_val):
    # Nombre del TIPO de C_EtiquetaArmaduras que le toca a la barra en la PLANTA, o None si
    # su Layout no tiene regla definida. Por defecto manda TIPO_TAG_POR_LAYOUT; la unica
    # excepcion son las BARRAS DE AJUSTE (Layout "Single" + Partition PPL-SUP/PPL-INF, ver
    # el bloque de constantes mas arriba), que llevan NOMBRE_TIPO_TAG_AJUSTE.
    layout = (layout_txt or '').strip().lower()
    if layout == 'single' and (partition_val or '').strip().upper() in PARTITIONS_BARRA_AJUSTE:
        return NOMBRE_TIPO_TAG_AJUSTE
    return TIPO_TAG_POR_LAYOUT.get(layout)

def es_estribo_stirrup_tie(r):
    # 2026-07-21 (pedido de Javier, solo para los CORTES): identifica si la barra usa
    # una RebarShape de estilo StirrupTie (estribo/amarra) - en ese caso, la Multi-Rebar
    # Annotation del corte debe usar NOMBRE_TIPO_MULTIREBAR_ESTRIBO en vez del tipo
    # general. RebarShapeDrivenAccessor no expone el RebarStyle directo (mismo problema
    # que el Layout Rule, ver leer_layout_rule) - se resuelve via el parametro de
    # instancia 'Rebar Shape' (BuiltInParameter.REBAR_SHAPE, referencia a un elemento
    # RebarShape), con fallback a buscar por nombre de parametro si ese BuiltInParameter
    # no aplicara en este Revit. RebarShape.RebarStyle SI es una propiedad real de la
    # API (no un parametro), se lee directo una vez resuelto el elemento.
    if not isinstance(r, Rebar):
        return False
    shape = None
    try:
        p = r.get_Parameter(BuiltInParameter.REBAR_SHAPE)
        if p is not None and p.StorageType == StorageType.ElementId:
            cand = doc.GetElement(p.AsElementId())
            if isinstance(cand, RebarShape):
                shape = cand
    except Exception:
        shape = None
    if shape is None:
        try:
            for p in r.Parameters:
                try:
                    nombre = p.Definition.Name
                except Exception:
                    continue
                if 'shape' in nombre.lower() and p.StorageType == StorageType.ElementId:
                    cand = doc.GetElement(p.AsElementId())
                    if isinstance(cand, RebarShape):
                        shape = cand
                        break
        except Exception:
            pass
    if shape is None:
        return False
    try:
        return shape.RebarStyle == RebarStyle.StirrupTie
    except Exception:
        return False

def proyectar_al_plano_vista(v, d):
    # componente de d dentro del plano de la vista (sin la parte a lo largo de
    # ViewDirection), normalizada. None si d es (casi) paralelo a ViewDirection.
    try:
        vd = v.ViewDirection
        en_plano = d.Subtract(vd.Multiply(d.DotProduct(vd)))
        if en_plano.GetLength() < 1e-6:
            return None
        return en_plano.Normalize()
    except Exception:
        return None

def tangente_barra_en_plano(r, v):
    # tangente de la primera curva de la barra (Rebar.GetCenterlineCurves), proyectada
    # al plano de la vista - direccion real de la barra en pantalla. La usan tanto
    # direccion_cota_multirebar (rotada 90, de fallback) como el empuje hacia afuera de
    # los Rebar Tag (directa, sin rotar - un Rebar Tag no tiene la restriccion de
    # perpendicularidad que exige Revit para Multi-Rebar Annotation, ver mas abajo).
    try:
        curvas = r.GetCenterlineCurves(False, True, True, MultiplanarOption.IncludeOnlyPlanarCurves, 0)
    except Exception:
        return None
    for c in curvas:
        try:
            tangente = c.GetEndPoint(1).Subtract(c.GetEndPoint(0))
        except Exception:
            continue
        if tangente.GetLength() < 1e-6:
            continue
        d = proyectar_al_plano_vista(v, tangente.Normalize())
        if d is not None:
            return d
    return None

def direccion_cota_multirebar(r, v):
    # Direccion de la linea de cota del Multi-Rebar Annotation. Revit exige que las
    # referencias (las barras del set, lineas en la planta) sean PERPENDICULARES a la
    # linea de cota - o sea, la cota corre a lo largo del camino de distribucion del
    # set (2026-07-15, error real de la primera corrida: "references must be linear
    # references which are perpendicular to the dimension line", con la diagonal del
    # bounding box como direccion). Preferencia: la direccion del distribution path
    # del accessor shape-driven (que si expone ESTE getter, a diferencia del Layout
    # Rule, que no tiene ninguno - ver leer_layout_rule); fallback: perpendicular a la
    # tangente de la barra (tangente_barra_en_plano) en el plano de la vista.
    try:
        acc = r.GetShapeDrivenAccessor()
        camino = acc.GetDistributionPath()
        d = proyectar_al_plano_vista(v, camino.Direction)
        if d is not None:
            return d, 'distribution path'
    except Exception:
        pass
    tangente = tangente_barra_en_plano(r, v)
    if tangente is not None:
        try:
            perp = v.ViewDirection.CrossProduct(tangente)
            d = proyectar_al_plano_vista(v, perp)
            if d is not None:
                return d, 'perpendicular al eje de la barra'
        except Exception:
            pass
    return None, None

def posicion_afuera_assembly(centro, direccion, v, off_plan):
    # Empuja 'centro' hacia afuera del CROP BOX de la vista (ya ajustado por 00 justo
    # al borde visible del assembly, con un margen chico y PAREJO en las 4
    # direcciones - ver ajustar_crop_planta de 00), perpendicular a 'direccion', con
    # lado FIJO por familia de direccion (2026-07-15, ver Multi-Rebar Annotation):
    # sets/tags cuyo eje perpendicular es mas vertical van siempre ARRIBA; los que dan
    # mas horizontal van siempre a la IZQUIERDA. No decide por en que mitad del
    # assembly cae el centro de ESTE elemento en particular - ese criterio inicial
    # mandaba elementos con centro casi exacto al medio a lados distintos de forma
    # inconsistente segun redondeo. Devuelve tambien empuje_vertical (2026-07-20): True
    # si el empuje fue hacia ARRIBA, False si fue hacia el COSTADO (izquierda) - lo usa
    # el Multi-Rebar Annotation para saber cuando rotar el texto a Vertical.
    # 2026-07-20: antes media el borde con la geometria solida cruda (collect_faces),
    # que puede incluir hormigon que no se ve en el dibujo (ej. la losa de fundacion) y
    # se extiende de forma asimetrica mas alla del refuerzo visible segun la direccion
    # - el mismo offset_mm terminaba viendose con margenes bien distintos empujando
    # hacia arriba vs hacia el costado. El CropBox no tiene ese problema: es el mismo
    # rectangulo parejo en las 4 direcciones que ya ve el usuario en el dibujo.
    perp = v.ViewDirection.CrossProduct(direccion)
    if perp.GetLength() < 1e-6:
        perp = v.RightDirection
    else:
        perp = perp.Normalize()
    up_v = v.UpDirection
    right_v = v.RightDirection
    empuje_vertical = abs(perp.DotProduct(up_v)) >= abs(perp.DotProduct(right_v))
    if empuje_vertical:
        if perp.DotProduct(up_v) < 0:
            perp = perp.Negate()
    else:
        if perp.DotProduct(right_v) > 0:
            perp = perp.Negate()
    bb = v.CropBox
    maxv = None
    for x in (bb.Min.X, bb.Max.X):
        for y in (bb.Min.Y, bb.Max.Y):
            p = bb.Transform.OfPoint(XYZ(x, y, 0.0))
            val = p.DotProduct(perp)
            if maxv is None or val > maxv:
                maxv = val
    val_centro = centro.DotProduct(perp)
    destino = maxv + off_plan
    return centro.Add(perp.Multiply(destino - val_centro)), empuje_vertical, perp

# --- assemblies objetivo (unicos por tipo, igual que 02) ---
by_type = {}
for ai in FilteredElementCollector(doc).OfClass(AssemblyInstance):
    by_type.setdefault(ai.AssemblyTypeName, []).append(ai)

if process_all:
    targets = sorted(by_type.keys())
else:
    tokens = [t.strip().lower() for t in filter_text.split(',') if t.strip()]
    if tokens:
        targets = [n for n in sorted(by_type.keys())
                   if any(tok in n.lower() for tok in tokens)]
    else:
        targets = []
        log.append('ERROR: \"Todos\" esta en False y el filtro esta vacio.')

views = {}
for v in FilteredElementCollector(doc).OfClass(View):
    if not v.IsTemplate:
        views[elem_name(v)] = v

def add_solid_faces(out, s, trf, cat_id, el_id):
    for f in s.Faces:
        if isinstance(f, PlanarFace) and f.Reference is not None:
            n = f.FaceNormal
            buv = f.GetBoundingBox()
            uv = UV((buv.Min.U + buv.Max.U) / 2.0, (buv.Min.V + buv.Max.V) / 2.0)
            p = f.Evaluate(uv)
            if trf is not None:
                n = trf.OfVector(n)
                p = trf.OfPoint(p)
            out.append((f.Reference, n, p, cat_id, el_id))

def collect_faces(ai):
    # caras planas con referencia de (a) TODOS los miembros de PRIMER NIVEL del
    # assembly, sea cual sea su tipo, y (b) TODAS las FamilyInstance anidadas a
    # cualquier profundidad (instancias_recursivas) - 2026-07-21 fix: instancias_recursivas
    # SOLO devuelve FamilyInstance (`if not isinstance(el, FamilyInstance): continue`);
    # un Floor (System Family, no FamilyInstance) que forme el borde real del assembly
    # quedaba totalmente afuera de faces si SOLO se recorria instancias_recursivas, y
    # extremes(faces, ...) terminaba agarrando la cara de un pedestal (mas cerca, no el
    # borde real) como "mejor candidato disponible" para las cotas de cobertura de la
    # Multi-Rebar Annotation - sin ningun error, solo un valor mas chico de lo real.
    # Se combinan ambos recorridos (con un set 'vistos' para no procesar el mismo
    # ElementId dos veces) para cubrir TANTO miembros de primer nivel que no son
    # FamilyInstance (Floors, etc.) COMO el anidamiento profundo (2026-07-20, ver
    # commit anterior: familia combinada Fundacion+Pedestal -> C-Pedestal anidado ->
    # su propia C-CapaCimiento G35 anidada dentro del pedestal, que con SOLO
    # ai.GetMemberIds() quedaba fuera o con la categoria del contenedor).
    out = []
    opt = Options()
    opt.ComputeReferences = True
    opt.DetailLevel = ViewDetailLevel.Fine
    vistos = set()
    def procesar(el):
        if el is None:
            return
        try:
            eid = el.Id.Value
        except Exception:
            eid = None
        if eid is not None:
            if eid in vistos:
                return
            vistos.add(eid)
        try:
            geo = el.get_Geometry(opt)
        except Exception:
            geo = None
        if geo is None:
            return
        cat_id = el.Category.Id if el.Category is not None else None
        for g in geo:
            if isinstance(g, Solid) and g.Volume > 1e-9:
                add_solid_faces(out, g, None, cat_id, eid)
            elif isinstance(g, GeometryInstance):
                trf = g.Transform
                for sg in g.GetSymbolGeometry():
                    if isinstance(sg, Solid) and sg.Volume > 1e-9:
                        add_solid_faces(out, sg, trf, cat_id, eid)
    for mid in ai.GetMemberIds():
        procesar(doc.GetElement(mid))
    for el in instancias_recursivas(ai):
        procesar(el)
    return out

def extremes(faces, d):
    # las dos caras mas extremas cuya normal es paralela a d
    cands = [(ref, p) for ref, n, p, c, e in faces if abs(n.DotProduct(d)) > PARALELO]
    if len(cands) < 2:
        return None
    lo = min(cands, key=lambda c: c[1].DotProduct(d))
    hi = max(cands, key=lambda c: c[1].DotProduct(d))
    if hi[1].DotProduct(d) - lo[1].DotProduct(d) < MIN_DIST:
        return None
    return lo, hi

def dim_line(d, perp, perp_value, p_lo, p_hi):
    # linea paralela a d, desplazada a perp_value sobre el eje perp
    c = p_lo.Add(p_hi).Multiply(0.5)
    base = c.Add(perp.Multiply(perp_value - c.DotProduct(perp)))
    q1 = base.Add(d.Multiply(p_lo.DotProduct(d) - base.DotProduct(d)))
    q2 = base.Add(d.Multiply(p_hi.DotProduct(d) - base.DotProduct(d)))
    return Line.CreateBound(q1, q2)

def crear_cotas_cobertura_multirebar(vplan, faces, r, dir_multi, perp, posicion_multi, tname):
    # Pedido de jefatura (2026-07-21): ademas de la Multi-Rebar Annotation, dos
    # Aligned Dimension mas, A LA MISMA ALTURA (mismo offset perpendicular, perp) que
    # la anotacion: borde del assembly -> primera barra del array, y ultima barra ->
    # borde opuesto ("cobertura" a cada lado del array). El borde se mide con
    # extremes(faces, dir_multi) SIN filtrar por categoria (faces completo, sin
    # restringir a Structural Foundation) -- a veces el elemento que forma ese borde es un Floor, no un
    # Structural Foundation, y esto se comporta como el bounding box real del
    # assembly con referencias reales de Revit, sin importar la categoria. La
    # primera/ultima barra del array: Rebar.GetSubelements()[i].GetReference() sirve
    # para IndependentTag.Create (ver referencias_para_tag) pero Revit la rechaza para
    # NewDimension ("Invalid number of references", 2026-07-21, confirmado en corrida
    # real) -- hace falta una referencia de CURVA (ComputeReferences=True sobre la
    # geometria, mismo mecanismo que el ultimo fallback de referencias_para_tag). La
    # barra ya esta en modo RebarPresentationMode.FirstLast PARA ESTA VISTA (ver 00),
    # asi que pedir su geometria CON la vista como contexto (Options.View = vplan) ya
    # devuelve solo esas dos barras simplificadas -- no hace falta elegir entre mas de
    # dos. Se ordenan por proyeccion sobre dir_multi (min = primera, max = ultima) en
    # vez de asumir un orden fijo.
    try:
        opt_barras = Options()
        opt_barras.ComputeReferences = True
        opt_barras.View = vplan
        geo_barras = r.get_Geometry(opt_barras)
    except Exception:
        geo_barras = None
    if geo_barras is None:
        return 0
    candidatos = []
    for g in geo_barras:
        ref_g = getattr(g, 'Reference', None)
        if ref_g is None:
            continue
        try:
            p0 = g.GetEndPoint(0)
            p1 = g.GetEndPoint(1)
        except Exception:
            continue
        centro_g = p0.Add(p1).Multiply(0.5)
        candidatos.append((ref_g, centro_g.DotProduct(dir_multi)))
    if len(candidatos) < 2:
        return 0
    candidatos.sort(key=lambda c: c[1])
    ref_primera = candidatos[0][0]
    ref_ultima = candidatos[-1][0]
    ext = extremes(faces, dir_multi)
    if ext is None:
        log.append('AVISO {}: barra {} sin caras extremas para la cota de cobertura.'.format(tname, r.Id.Value))
        return 0
    (lo_ref, p_lo), (hi_ref, p_hi) = ext
    perp_value = posicion_multi.DotProduct(perp)
    creadas = 0
    try:
        ra1 = ReferenceArray()
        ra1.Append(lo_ref)
        ra1.Append(ref_primera)
        line1 = dim_line(dir_multi, perp, perp_value, p_lo, posicion_multi)
        doc.Create.NewDimension(vplan, line1, ra1)
        creadas += 1
    except Exception as e:
        log.append('ERROR {} cota de cobertura inicial (barra {}): {}'.format(tname, r.Id.Value, e))
    try:
        ra2 = ReferenceArray()
        ra2.Append(ref_ultima)
        ra2.Append(hi_ref)
        line2 = dim_line(dir_multi, perp, perp_value, posicion_multi, p_hi)
        doc.Create.NewDimension(vplan, line2, ra2)
        creadas += 1
    except Exception as e:
        log.append('ERROR {} cota de cobertura final (barra {}): {}'.format(tname, r.Id.Value, e))
    return creadas

def refs_curvas_horizontales(r, vsec, up):
    # Referencias de curva de la barra (en modo FirstLast devuelve solo la 1a y ultima
    # barra del array) que se ven como LINEA HORIZONTAL en el plano del corte
    # (abs(tang.RightDirection) >= 0.9). Filtrar a horizontales evita la COTA DIAGONAL: una
    # barra vista de punta, o el lado vertical de un estribo, da una referencia de PUNTO, y
    # una Dimension entre dos puntos a distinto X mide la distancia real (diagonal), no la
    # vertical (bug real 2026-07-21). Devuelve [(Reference, proj_en_up, punto_medio)]
    # ordenadas por proyeccion en up (menor = mas abajo, mayor = mas arriba).
    right = vsec.RightDirection
    try:
        opt = Options()
        opt.ComputeReferences = True
        opt.View = vsec
        geo = r.get_Geometry(opt)
    except Exception:
        return []
    if geo is None:
        return []
    res = []
    for g in geo:
        ref_g = getattr(g, 'Reference', None)
        if ref_g is None:
            continue
        try:
            p0 = g.GetEndPoint(0)
            p1 = g.GetEndPoint(1)
        except Exception:
            continue
        tang = p1.Subtract(p0)
        if tang.GetLength() < 1e-9:
            continue
        tang = tang.Normalize()
        if abs(tang.DotProduct(right)) < 0.9:
            continue
        centro_g = p0.Add(p1).Multiply(0.5)
        res.append((ref_g, centro_g.DotProduct(up), centro_g))
    res.sort(key=lambda c: c[1])
    return res

def corte_ya_tiene_cadena(vsec):
    # Idempotencia de la cadena: cada Multi-Rebar Annotation crea su propia Dimension
    # (DimensionId). Si en el corte hay alguna OST_Dimensions que NO pertenece a una
    # anotacion, la cadena vertical ya se creo (en un corte no hay otras cotas - el 04 solo
    # acota plantas aparte). Requiere doc.Regenerate() antes, para que los DimensionId de
    # las anotaciones recien creadas esten poblados.
    dims_anotacion = set()
    for a in (FilteredElementCollector(doc, vsec.Id)
              .OfCategory(BuiltInCategory.OST_MultiReferenceAnnotations)
              .OfClass(MultiReferenceAnnotation)):
        try:
            did = a.DimensionId
            if did is not None and did != ElementId.InvalidElementId:
                dims_anotacion.add(did.Value)
        except Exception:
            pass
    for d in (FilteredElementCollector(doc, vsec.Id)
              .OfCategory(BuiltInCategory.OST_Dimensions)
              .WhereElementIsNotElementType()):
        if d.Id.Value not in dims_anotacion:
            return True
    return False

def crear_cadena_vertical_corte(vsec, faces, barras, tname, offset_mm_val):
    # Cadena VERTICAL de cotas de cobertura en el corte (pedido de Javier; re-implementada
    # 2026-07-25 - existio el 2026-07-21 y se habia revertido junto con la cota de altura).
    # Analoga a las cotas de cobertura de la planta (crear_cotas_cobertura_multirebar) pero
    # ENCADENADA a lo largo de la altura (UpDirection): cara superior -> 1a barra del set
    # mas alto (cobertura superior); ultima barra de un set -> 1a barra del siguiente (hueco
    # entre sets consecutivos); ultima barra del set mas bajo -> cara inferior (cobertura
    # inferior). El span INTERNO de cada set NO se cota (eso lo muestra la Multi-Rebar
    # Annotation roja). Solo participan los sets Number with Spacing con distribucion
    # ~vertical (barras apiladas en altura) - los mismos que la anotacion empuja al costado.
    # Va al MISMO offset lateral que las anotaciones (no mas afuera).
    if corte_ya_tiene_cadena(vsec):
        log.append('{}: {} ya tiene cadena vertical de cobertura, se salta.'.format(tname, elem_name(vsec)))
        return 0
    up = vsec.UpDirection
    right = vsec.RightDirection
    ext = extremes(faces, up)
    if ext is None:
        log.append('AVISO {}: {} sin caras superior/inferior para la cadena vertical.'.format(tname, elem_name(vsec)))
        return 0
    (cara_lo_ref, p_lo), (cara_hi_ref, p_hi) = ext
    info = []
    for r in barras:
        try:
            if not r.CanApplyPresentationMode(vsec):
                continue
        except Exception:
            continue
        layout_txt, _e = leer_layout_rule(r)
        if layout_txt is None or layout_txt.strip().lower() != 'number with spacing':
            continue
        dir_multi, _via = direccion_cota_multirebar(r, vsec)
        if dir_multi is None:
            continue
        # solo distribucion ~vertical (barras apiladas en altura)
        if abs(dir_multi.DotProduct(up)) < abs(dir_multi.DotProduct(right)):
            continue
        try:
            if r.GetPresentationMode(vsec) != RebarPresentationMode.FirstLast:
                r.SetPresentationMode(vsec, RebarPresentationMode.FirstLast)
        except Exception:
            pass
        refs = refs_curvas_horizontales(r, vsec, up)
        if len(refs) < 2:
            log.append('AVISO {}: barra {} sin curva horizontal en el plano, se omite de la cadena vertical.'.format(tname, r.Id.Value))
            continue
        info.append({'sup': refs[-1], 'inf': refs[0], 'c': (refs[0][1] + refs[-1][1]) / 2.0})
    if not info:
        return 0
    info.sort(key=lambda s: -s['c'])  # el mas alto primero
    centro_ref = p_lo.Add(p_hi).Multiply(0.5)
    off_plan = offset_mm_val / 304.8 * vsec.Scale
    pos, _ev, perp = posicion_afuera_assembly(centro_ref, up, vsec, off_plan)
    perp_value = pos.DotProduct(perp)
    segmentos = [(cara_hi_ref, p_hi, info[0]['sup'][0], info[0]['sup'][2])]
    for i in range(len(info) - 1):
        a = info[i]['inf']
        b = info[i + 1]['sup']
        segmentos.append((a[0], a[2], b[0], b[2]))
    ult = info[-1]['inf']
    segmentos.append((ult[0], ult[2], cara_lo_ref, p_lo))
    creadas = 0
    for ref_a, p_a, ref_b, p_b in segmentos:
        try:
            ra = ReferenceArray()
            ra.Append(ref_a)
            ra.Append(ref_b)
            line = dim_line(up, perp, perp_value, p_a, p_b)
            doc.Create.NewDimension(vsec, line, ra)
            creadas += 1
        except Exception as e:
            log.append('ERROR {} segmento de cadena vertical en {}: {}'.format(tname, elem_name(vsec), e))
    if creadas:
        log.append('OK {}: cadena vertical de cobertura en {} con {} segmentos ({} sets).'.format(tname, elem_name(vsec), creadas, len(info)))
    return creadas

# --- NOTAS DE RECUENTO EN LOS CALLOUTS DE PEDESTAL (2026-07-28, pedido de Javier con
#     imagen de referencia) -------------------------------------------------------
# Dos notas de texto con directriz en CADA callout de pedestal (los que 01 crea desde la
# planta; NO aplica a plantas ni a cortes):
#   - arriba a la DERECHA: recuento de la armadura principal del pedestal (Partition
#     PPL-PPL) + su ITEM_TBL, formato '8-1605'.
#   - arriba a la IZQUIERDA: recuento de ESTRIBOS (Partition SEC-EST) + su ITEM_TBL,
#     pero la cantidad se escribe como una suma simple con un 1 antepuesto:
#     10 estribos -> '1+9', o sea '1+9-1001'.
# El recuento es de BARRAS REALES: se suma el parametro Quantity de cada set, asi que un
# set multibar cuenta todas sus barras, no una. Verificado contra el modelo real via MCP
# sobre FN-01 / PD-1001: PPL-PPL Quantity 3+1+1+3 = 8 con ITEM_TBL 1605, y SEC-EST 4+6 =
# 10 con ITEM_TBL 1001 -> exactamente el '8-1605' / '1+9-1001' de la imagen de referencia.
PREFIJO_PEDESTAL = SUFIJO_ARMADURAS + ' - PEDESTAL '
PARTITION_PPL_PEDESTAL = 'PPL-PPL'
PARTITION_ESTRIBO_PEDESTAL = 'SEC-EST'
# mm de PAPEL (se convierten con la escala del callout): cuanto sube la nota sobre el
# borde superior del crop, y cuanto se corre hacia su lado respecto del borde lateral.
OFFSET_NOTA_CALLOUT_MM = 6.0
SANGRIA_NOTA_CALLOUT_MM = 2.0
# largo del primer tramo HORIZONTAL de la directriz (el codo), en mm de papel.
LARGO_CODO_NOTA_MM = 8.0

def tipo_texto_por_defecto():
    try:
        tid = doc.GetDefaultElementTypeId(ElementTypeGroup.TextNoteType)
        if tid is not None and tid != ElementId.InvalidElementId:
            return tid
    except Exception:
        pass
    for t in FilteredElementCollector(doc).OfClass(TextNoteType):
        return t.Id
    return None

tipo_texto_id = tipo_texto_por_defecto()
if tipo_texto_id is None:
    log.append('AVISO: no hay ningun tipo de Text Note en el proyecto; las notas de recuento de los callouts de pedestal se omiten.')

def leer_item_tbl(r):
    # ITEM_TBL = parametro COMPARTIDO de texto que cargan los modeladores (la marca de
    # la barra en la tabla de despiece, ej. 1605). Es el mismo dato que agrupa el
    # schedule del 05.
    try:
        p = r.LookupParameter('ITEM_TBL')
    except Exception:
        p = None
    if p is None:
        return None
    valor = None
    try:
        valor = p.AsString()
    except Exception:
        valor = None
    if not valor:
        try:
            valor = p.AsValueString()
        except Exception:
            valor = None
    return valor.strip() if valor else None

def cantidad_de_barras(r):
    # Quantity = cuantas barras tiene el SET (1 si es una barra suelta). Se suma sobre
    # todos los sets para que un multibar cuente todas sus barras, no una sola.
    try:
        p = r.LookupParameter('Quantity')
    except Exception:
        p = None
    if p is None:
        return 1
    try:
        st = p.StorageType
        if st == StorageType.Integer:
            return int(p.AsInteger())
        if st == StorageType.Double:
            return int(round(p.AsDouble()))
        txt = p.AsString()
        if not txt:
            txt = p.AsValueString()
        return int(float(txt))
    except Exception:
        return 1

def texto_cantidad_estribos(total):
    # Formato pedido por Javier: la cantidad de estribos NO se escribe pelada, se parte
    # en una suma simple con un 1 antepuesto (10 -> '1+9'). Con un solo estribo no hay
    # resto que sumar y queda '1'.
    if total <= 1:
        return '1'
    return '1+{}'.format(total - 1)

def hosts_de_barras_visibles(callout):
    # Host(s) de hormigon del pedestal que dibuja este callout. Se sacan de las barras
    # VISIBLES en la vista: 01 (limitar_callout_a_pedestal) ya oculto todo lo que no es
    # de este pedestal, asi que cualquier barra visible sirve de ancla confiable.
    hosts = set()
    for r in (FilteredElementCollector(doc, callout.Id)
              .OfCategory(BuiltInCategory.OST_Rebar)
              .WhereElementIsNotElementType()):
        try:
            hid = r.GetHostId()
        except Exception:
            hid = None
        if hid is not None and hid.Value >= 0:
            hosts.add(hid.Value)
    return hosts

def barras_del_pedestal_por_partition(callout, barras_assembly):
    # Barras que cuentan para las notas, agrupadas por Partition.
    #
    # NO alcanza con contar lo VISIBLE en el callout (bug real 2026-07-28, reportado por
    # Javier: varias notas contaban de menos). El callout es un callout de PLANTA y
    # hereda su rango de vista, asi que los sets de estribos que caen fuera de ese rango
    # NO los devuelve el colector por vista. Verificado por MCP contra el modelo real: en
    # el callout de PD-1004 el colector devolvia UN solo set SEC-EST (Quantity 5 -> la
    # nota decia 1+4) aunque el pedestal tiene 9 estribos; PD-1003 de FN-01 daba bien de
    # casualidad, porque sus dos sets (4+5) caen dentro del rango.
    #
    # Ancla: el HOST de hormigon. Se toman los hosts de las barras visibles y se cuenta
    # CUALQUIER barra del assembly hospedada en ellos, este o no visible en la vista. Es
    # el mismo criterio de host con el que 01 decide que barras son de este pedestal, asi
    # que las dos rutinas no se desincronizan.
    #
    # Ampliar por host es seguro aunque el host sea COMPARTIDO con la zapata (familias
    # combinadas fundacion+pedestal): las notas solo miran las Partitions PPL-PPL y
    # SEC-EST, exclusivas del pedestal - la armadura de zapata (PPL-SUP / PPL-INF /
    # SEC-LAT) nunca cae en esos dos grupos.
    grupos = {}
    hosts = hosts_de_barras_visibles(callout)
    if not hosts:
        return grupos
    for r in barras_assembly:
        try:
            hid = r.GetHostId()
        except Exception:
            hid = None
        if hid is None or hid.Value not in hosts:
            continue
        part = leer_partition(r)
        if not part:
            continue
        grupos.setdefault(part.strip().upper(), []).append(r)
    return grupos

def bbox_local_barras(callout, barras):
    # bbox de las barras en el sistema LOCAL del CropBox del callout (X = derecha de la
    # vista, Y = arriba), para poder hablar de "esquina superior derecha" sin depender de
    # como este orientado el callout en el mundo.
    inv = callout.CropBox.Transform.Inverse
    minx = miny = float('inf')
    maxx = maxy = float('-inf')
    hay = False
    for r in barras:
        try:
            bb = r.get_BoundingBox(callout)
            if bb is None:
                bb = r.get_BoundingBox(None)
        except Exception:
            bb = None
        if bb is None:
            continue
        for x in (bb.Min.X, bb.Max.X):
            for y in (bb.Min.Y, bb.Max.Y):
                for z in (bb.Min.Z, bb.Max.Z):
                    p = inv.OfPoint(XYZ(x, y, z))
                    hay = True
                    if p.X < minx: minx = p.X
                    if p.X > maxx: maxx = p.X
                    if p.Y < miny: miny = p.Y
                    if p.Y > maxy: maxy = p.Y
    if not hay:
        return None
    return (minx, miny, maxx, maxy)

def notas_recuento_callout(callout, tname, barras_assembly):
    # Crea las dos notas del callout. Idempotente por VISTA: si el callout ya tiene
    # alguna nota de texto (de una corrida anterior o puesta a mano), no se toca nada.
    if tipo_texto_id is None:
        return 0
    try:
        ya = (FilteredElementCollector(doc, callout.Id)
              .OfCategory(BuiltInCategory.OST_TextNotes)
              .WhereElementIsNotElementType().GetElementCount())
    except Exception:
        ya = 0
    if ya > 0:
        log.append('{}: {} ya tiene notas de texto, se salta.'.format(tname, elem_name(callout)))
        return 0
    # Las notas van A PROPOSITO por fuera del crop del modelo (arriba del pedestal,
    # como la imagen de referencia). Si el callout heredo del template el crop de
    # ANOTACIONES activo, Revit las recortaria y no se verian: se desactiva aca.
    try:
        p_ann = callout.get_Parameter(BuiltInParameter.VIEWER_ANNOTATION_CROP_ACTIVE)
        if p_ann is not None and not p_ann.IsReadOnly and p_ann.AsInteger() == 1:
            p_ann.Set(0)
    except Exception:
        pass
    grupos = barras_del_pedestal_por_partition(callout, barras_assembly)
    cb = callout.CropBox
    tr = cb.Transform
    escala = callout.Scale if callout.Scale > 0 else 1
    off = OFFSET_NOTA_CALLOUT_MM / 304.8 * escala
    sangria = SANGRIA_NOTA_CALLOUT_MM / 304.8 * escala
    y_texto = cb.Max.Y + off
    # (Partition, alinear_texto_a_la_derecha, x del texto, lado del leader)
    jobs = (
        (PARTITION_PPL_PEDESTAL, False, cb.Max.X + sangria, 'derecha'),
        (PARTITION_ESTRIBO_PEDESTAL, True, cb.Min.X - sangria, 'izquierda'),
    )
    creadas = 0
    for partition_val, alinear_der, x_texto, lado in jobs:
        barras_grp = grupos.get(partition_val, [])
        if not barras_grp:
            log.append('AVISO {}: {} no tiene barras {} visibles; se omite la nota de la {}.'.format(
                tname, elem_name(callout), partition_val, lado))
            continue
        total_barras = 0
        for r in barras_grp:
            total_barras += cantidad_de_barras(r)
        item = None
        for r in barras_grp:
            item = leer_item_tbl(r)
            if item:
                break
        if partition_val == PARTITION_ESTRIBO_PEDESTAL:
            cantidad_txt = texto_cantidad_estribos(total_barras)
        else:
            cantidad_txt = str(total_barras)
        if item:
            texto = '{}-{}'.format(cantidad_txt, item)
        else:
            texto = cantidad_txt
            log.append('AVISO {}: las barras {} de {} no tienen ITEM_TBL cargado; la nota queda solo con la cantidad.'.format(
                tname, partition_val, elem_name(callout)))
        caja = bbox_local_barras(callout, barras_grp)
        if caja is None:
            log.append('AVISO {}: no se pudo medir las barras {} en {}; nota omitida.'.format(
                tname, partition_val, elem_name(callout)))
            continue
        minx, miny, maxx, maxy = caja
        # la principal se apunta en su esquina superior DERECHA y el estribo en la
        # superior IZQUIERDA, para que cada directriz salga hacia su lado sin cruzar
        # el pedestal (igual que la imagen de referencia).
        if alinear_der:
            destino_local = XYZ(minx, maxy, 0.0)
        else:
            destino_local = XYZ(maxx, maxy, 0.0)
        try:
            opciones = TextNoteOptions(tipo_texto_id)
            if alinear_der:
                opciones.HorizontalAlignment = HorizontalTextAlignment.Right
            else:
                opciones.HorizontalAlignment = HorizontalTextAlignment.Left
            origen = tr.OfPoint(XYZ(x_texto, y_texto, 0.0))
            nota = TextNote.Create(doc, callout.Id, origen, texto, opciones)
            if alinear_der:
                leader = nota.AddLeader(TextNoteLeaderTypes.TNLT_STRAIGHT_R)
            else:
                leader = nota.AddLeader(TextNoteLeaderTypes.TNLT_STRAIGHT_L)
            # El primer tramo de la directriz tiene que salir HORIZONTAL del texto
            # (2026-07-28, Javier: el tope de linea recto en vez de diagonal). La altura
            # buena NO es la del origen del TextNote sino la del punto donde Revit
            # engancha la directriz al texto (leader.Anchor): no coinciden, y por eso la
            # primera version arrancaba en diagonal desde el propio texto. Hace falta
            # regenerar para que Anchor quede poblado.
            x_anc, y_anc = x_texto, y_texto
            try:
                doc.Regenerate()
                anc = tr.Inverse.OfPoint(leader.Anchor)
                x_anc, y_anc = anc.X, anc.Y
            except Exception:
                pass
            try:
                largo_codo = LARGO_CODO_NOTA_MM / 304.8 * escala
                # el codo sale hacia el lado por el que la directriz abandona el texto:
                # a la derecha en la nota izquierda (TNLT_STRAIGHT_R) y viceversa.
                x_codo = (x_anc + largo_codo) if alinear_der else (x_anc - largo_codo)
                leader.Elbow = tr.OfPoint(XYZ(x_codo, y_anc, 0.0))
                leader.End = tr.OfPoint(destino_local)
            except Exception as e:
                log.append('AVISO {}: no se pudo apuntar la directriz de la nota {} en {}: {}'.format(
                    tname, partition_val, elem_name(callout), e))
            creadas += 1
            log.append('OK {}: nota {} en {} ({} barras).'.format(tname, texto, elem_name(callout), total_barras))
        except Exception as e:
            log.append('ERROR {} creando la nota {} en {}: {}'.format(tname, partition_val, elem_name(callout), e))
    return creadas

def has_tags(v):
    return (FilteredElementCollector(doc, v.Id)
            .OfCategory(BuiltInCategory.OST_MultiCategoryTags)
            .OfClass(IndependentTag).GetElementCount() > 0)

def elementos_ya_tageados(v):
    # ids de todos los elementos que ya tienen un Rebar Tag en esta vista
    # (para no re-etiquetar barras ya tageadas en corridas anteriores).
    tageados = set()
    for tg in (FilteredElementCollector(doc, v.Id)
               .OfCategory(BuiltInCategory.OST_RebarTags)
               .OfClass(IndependentTag)):
        try:
            for tid in tg.GetTaggedLocalElementIds():
                tageados.add(tid.Value)
        except Exception:
            pass
    return tageados

def elementos_ya_anotados_multirebar(v):
    # mismo patron que elementos_ya_tageados pero para Multi-Rebar Annotations
    # (categoria OST_MultiReferenceAnnotations, clase MultiReferenceAnnotation): junta
    # los ElementId de todas las referencias ya anotadas en esta vista, via
    # GetTaggedReferences() (lista de Reference, no de ElementId como IndependentTag).
    anotados = set()
    for an in (FilteredElementCollector(doc, v.Id)
               .OfCategory(BuiltInCategory.OST_MultiReferenceAnnotations)
               .OfClass(MultiReferenceAnnotation)):
        try:
            for ref in an.GetTaggedReferences():
                anotados.add(ref.ElementId.Value)
        except Exception:
            pass
    return anotados

def referencias_para_tag(r, vista):
    # Candidatos de Reference para IndependentTag.Create, en orden de preferencia.
    # Reference(elemento) directo fallo en este modelo ("The reference can not be
    # tagged", 2026-07-14) pese a que el tag manual por categoria SI funciona en la
    # misma vista: al clickear con el mouse, Revit taguea una barra concreta del SET,
    # y la API expone esas barras individuales como Subelements con su propia
    # Reference (GetSubelements()[i].GetReference()) - esa es la forma que suele
    # aceptar. Como fallback final, una referencia sacada de la geometria visible
    # (cara o curva con ComputeReferences=True).
    cands = []
    try:
        cands.append((Reference(r), 'Reference(elemento)'))
    except Exception:
        pass
    try:
        for sub in r.GetSubelements():
            try:
                ref_sub = sub.GetReference()
            except Exception:
                continue
            if ref_sub is not None:
                cands.append((ref_sub, 'subelemento'))
                break
    except Exception:
        pass
    try:
        opt = Options()
        opt.ComputeReferences = True
        opt.View = vista
        geo = r.get_Geometry(opt)
    except Exception:
        geo = None
    if geo is not None:
        ref_geo = None
        for g in geo:
            if isinstance(g, Solid) and g.Volume > 1e-9:
                for f in g.Faces:
                    if f.Reference is not None:
                        ref_geo = (f.Reference, 'cara de geometria')
                        break
            elif getattr(g, 'Reference', None) is not None:
                ref_geo = (g.Reference, 'curva de geometria')
            if ref_geo is not None:
                break
        if ref_geo is not None:
            cands.append(ref_geo)
    return cands

total = 0
TransactionManager.Instance.EnsureInTransaction(doc)

tag_types_arm = {}
faltantes_arm = set(TIPO_TAG_POR_LAYOUT.values())
faltantes_arm.add(NOMBRE_TIPO_TAG_AJUSTE)  # tipo de las BARRAS DE AJUSTE (2026-07-30)
for t in FilteredElementCollector(doc).OfCategory(BuiltInCategory.OST_RebarTags).WhereElementIsElementType():
    try:
        if t.FamilyName.strip().lower() == NOMBRE_FAMILIA_TAG_ARM.lower():
            nom = elem_name(t).strip()
            if nom in faltantes_arm:
                tag_types_arm[nom] = t
                faltantes_arm.discard(nom)
    except Exception:
        continue
if faltantes_arm:
    log.append('AVISO: no se encontraron estos tipos de "{}" (Rebar Tag): {}. Las barras que necesiten ese tipo no se etiquetan.'.format(
        NOMBRE_FAMILIA_TAG_ARM, ', '.join(sorted(faltantes_arm))))
    disponibles_arm = list(FilteredElementCollector(doc).OfCategory(BuiltInCategory.OST_RebarTags).WhereElementIsElementType())
    if disponibles_arm:
        log.append('Rebar Tags disponibles: ' + ', '.join(sorted('{} : {}'.format(t.FamilyName, elem_name(t)) for t in disponibles_arm)))
for t in tag_types_arm.values():
    if hasattr(t, 'IsActive') and not t.IsActive:
        t.Activate()

# tipo de Multi-Rebar Annotation (2026-07-15, ver NOMBRE_TIPO_MULTIREBAR mas arriba) -
# no es FamilySymbol (sin FamilyName/Activate), se busca por Name directo sobre la
# clase MultiReferenceAnnotationType.
tag_type_multirebar = None
for t in FilteredElementCollector(doc).OfClass(MultiReferenceAnnotationType):
    try:
        if elem_name(t).strip().lower() == NOMBRE_TIPO_MULTIREBAR.lower():
            tag_type_multirebar = t
            break
    except Exception:
        continue
if tag_type_multirebar is None:
    log.append('AVISO: no se encontro el Multi-Rebar Annotation Type {} (categoria Multi-Rebar Annotations); esa anotacion se omite.'.format(NOMBRE_TIPO_MULTIREBAR))
    disponibles_multirebar = list(FilteredElementCollector(doc).OfClass(MultiReferenceAnnotationType))
    if disponibles_multirebar:
        log.append('Multi-Rebar Annotation Types disponibles: ' + ', '.join(sorted(elem_name(t) for t in disponibles_multirebar)))
elif hasattr(tag_type_multirebar, 'IsActive') and not tag_type_multirebar.IsActive:
    tag_type_multirebar.Activate()

# tipo de Multi-Rebar Annotation para estribos/amarras en los CORTES (2026-07-21, ver
# NOMBRE_TIPO_MULTIREBAR_ESTRIBO y es_estribo_stirrup_tie mas arriba). Si no se
# encuentra, el corte cae de vuelta al tipo general (tag_type_multirebar) para esa
# barra - no se deja de anotar, solo no se distingue visualmente el estribo.
tag_type_multirebar_estribo = None
for t in FilteredElementCollector(doc).OfClass(MultiReferenceAnnotationType):
    try:
        if elem_name(t).strip().lower() == NOMBRE_TIPO_MULTIREBAR_ESTRIBO.lower():
            tag_type_multirebar_estribo = t
            break
    except Exception:
        continue
if tag_type_multirebar_estribo is None:
    log.append('AVISO: no se encontro el Multi-Rebar Annotation Type {} (para estribos en los cortes); esas barras usan el tipo general {}.'.format(NOMBRE_TIPO_MULTIREBAR_ESTRIBO, NOMBRE_TIPO_MULTIREBAR))
elif hasattr(tag_type_multirebar_estribo, 'IsActive') and not tag_type_multirebar_estribo.IsActive:
    tag_type_multirebar_estribo.Activate()

# tipo de tag para las familias de la planta (ex-05): C-MultiCat : Modelo
tag_type_familias = None
for t in FilteredElementCollector(doc).OfCategory(BuiltInCategory.OST_MultiCategoryTags).WhereElementIsElementType():
    try:
        if (t.FamilyName.strip().lower() == NOMBRE_FAMILIA_TAG_CAPA.lower()
                and elem_name(t).strip().lower() == NOMBRE_TIPO_TAG_FAMILIAS.lower()):
            tag_type_familias = t
            break
    except Exception:
        continue
if tag_type_familias is None:
    log.append('AVISO: no se encontro el tag "{} : {}" (Multi-Category Tag) para las familias de la planta (ex-05); ese tagueo se omite.'.format(
        NOMBRE_FAMILIA_TAG_CAPA, NOMBRE_TIPO_TAG_FAMILIAS))
elif hasattr(tag_type_familias, 'IsActive') and not tag_type_familias.IsActive:
    tag_type_familias.Activate()

try:
    for tname in targets:
        ai = by_type[tname][0]
        try:
            faces = collect_faces(ai)
            if not faces:
                log.append('ERROR {}: los miembros no exponen geometria con referencias.'.format(tname))
                continue
            pedestales_ai = pedestales_del_assembly(ai)
            pedestal_ids_ai = set(el.Id.Value for el in pedestales_ai) if len(pedestales_ai) >= 2 else set()
            # barras del assembly (miembro directo + hospedadas) - se usa tanto para la
            # planta como para el Multi-Rebar Annotation de los cortes (2026-07-21).
            barras_ai = rebar_del_assembly(ai)
            # ---------- PLANTA: tags de Structural Rebar (2026-07-14: ya NO se acota ancho/largo) ----------
            vplan = views.get(tname + SUFIJO_ARMADURAS)
            if vplan is None:
                log.append('AVISO {}: no existe la vista de planta (corre 01_Vistas de assembly).'.format(tname))
            else:
                # ---------- Tags de Structural Rebar en la planta (segun Layout) ----------
                # independiente de si la planta ya tenia cotas de una corrida anterior.
                if barras_ai:
                    ya_tageadas = elementos_ya_tageados(vplan)
                    ya_anotadas_multi = elementos_ya_anotados_multirebar(vplan) if tag_type_multirebar is not None else set()
                    pedestal_saltadas = 0
                    partition_saltadas = 0
                    multirebar_creadas = 0
                    for r in barras_ai:
                        if pedestal_ids_ai and es_barra_de_pedestal(r, pedestal_ids_ai):
                            pedestal_saltadas += 1
                            continue
                        partition_val = leer_partition(r)
                        if partition_val not in PARTITIONS_TAGEABLES:
                            partition_saltadas += 1
                            continue
                        if tag_type_multirebar is not None and r.Id.Value not in ya_anotadas_multi:
                            es_first_last = False
                            try:
                                if r.CanApplyPresentationMode(vplan):
                                    es_first_last = (r.GetPresentationMode(vplan) == RebarPresentationMode.FirstLast)
                            except Exception:
                                es_first_last = False
                            if es_first_last:
                                try:
                                    bb_multi = r.get_BoundingBox(vplan) or r.get_BoundingBox(None)
                                    if bb_multi is None:
                                        log.append('AVISO {}: barra {} sin bounding box, Multi-Rebar Annotation omitida.'.format(tname, r.Id.Value))
                                    else:
                                        centro_multi = XYZ((bb_multi.Min.X + bb_multi.Max.X) / 2.0, (bb_multi.Min.Y + bb_multi.Max.Y) / 2.0, (bb_multi.Min.Z + bb_multi.Max.Z) / 2.0)
                                        dir_multi, via_dir = direccion_cota_multirebar(r, vplan)
                                        if dir_multi is None:
                                            log.append('AVISO {}: barra {} sin direccion de distribucion calculable, Multi-Rebar Annotation omitida.'.format(tname, r.Id.Value))
                                        else:
                                            # Posicion HACIA AFUERA del assembly (2026-07-15, pedido: antes quedaba al
                                            # medio, coincidiendo con el centro de la barra) - ver posicion_afuera_assembly.
                                            off_plan = offset_mm / 304.8 * vplan.Scale
                                            posicion_multi, empuje_vertical_multi, perp_multi = posicion_afuera_assembly(centro_multi, dir_multi, vplan, off_plan)
                                            # MultiReferenceAnnotationOptions (2026-07-15, firma real confirmada por
                                            # reflexion en vivo sobre RevitAPI): NO recibe References como IndependentTag,
                                            # recibe un ElementId del Rebar (SetElementsToDimension) - el set completo es
                                            # UN Rebar, no hace falta el fallback de referencias_para_tag aca.
                                            opciones_multi = MultiReferenceAnnotationOptions(tag_type_multirebar)
                                            opciones_multi.SetElementsToDimension(List[ElementId]([r.Id]))
                                            opciones_multi.TagHasLeader = True
                                            opciones_multi.DimensionPlaneNormal = vplan.ViewDirection
                                            opciones_multi.DimensionLineDirection = dir_multi
                                            opciones_multi.DimensionLineOrigin = posicion_multi
                                            opciones_multi.TagHeadPosition = posicion_multi
                                            ann_multi = MultiReferenceAnnotation.Create(doc, vplan.Id, opciones_multi)
                                            # Texto vertical SOLO cuando el empuje fue hacia el costado (izquierda,
                                            # 2026-07-20): ahi el texto en Horizontal quedaba dificil de leer junto a
                                            # la cota vertical; arriba se deja en Horizontal (ese si se lee bien). El
                                            # tag interno ("Orientation" en el panel de Propiedades al Tab-seleccionar
                                            # solo el texto = TagOrientation por API) se llega via
                                            # MultiReferenceAnnotation.TagId.
                                            if not empuje_vertical_multi:
                                                try:
                                                    tag_multi = doc.GetElement(ann_multi.TagId)
                                                    if tag_multi is not None:
                                                        tag_multi.TagOrientation = TagOrientation.Vertical
                                                except Exception as e:
                                                    log.append('AVISO {}: no se pudo rotar el texto del Multi-Rebar Annotation (barra {}): {}'.format(tname, r.Id.Value, e))
                                            total += 1
                                            multirebar_creadas += 1
                                            log.append('OK {}: Multi-Rebar Annotation creada en planta (barra {}, direccion via {}).'.format(tname, r.Id.Value, via_dir))
                                            try:
                                                cobertura_creadas = crear_cotas_cobertura_multirebar(vplan, faces, r, dir_multi, perp_multi, posicion_multi, tname)
                                                if cobertura_creadas:
                                                    total += cobertura_creadas
                                                    log.append('OK {}: {} cota(s) de cobertura junto a la Multi-Rebar Annotation (barra {}).'.format(tname, cobertura_creadas, r.Id.Value))
                                            except Exception as e:
                                                log.append('ERROR {} cotas de cobertura (barra {}): {}'.format(tname, r.Id.Value, e))
                                except Exception as e:
                                    log.append('ERROR {} Multi-Rebar Annotation (barra {}): {}'.format(tname, r.Id.Value, e))
                        if r.Id.Value in ya_tageadas:
                            continue
                        layout_txt, error_layout = leer_layout_rule(r)
                        if layout_txt is None:
                            log.append('AVISO {}: barra {}: {}'.format(tname, r.Id.Value, error_layout))
                            continue
                        # partition_val ya se leyo arriba (es el que paso PARTITIONS_TAGEABLES):
                        # decide, junto con el Layout, si esta es una BARRA DE AJUSTE.
                        tipo_nombre = tipo_tag_planta(layout_txt, partition_val)
                        if tipo_nombre is None:
                            log.append('AVISO {}: Layout "{}" (barra {}) sin regla de tag definida, no se etiqueta.'.format(tname, layout_txt, r.Id.Value))
                            continue
                        tag_type_arm = tag_types_arm.get(tipo_nombre)
                        if tag_type_arm is None:
                            continue  # ya se aviso mas arriba que falta este tipo
                        try:
                            bb = r.get_BoundingBox(vplan) or r.get_BoundingBox(None)
                            if bb is None:
                                log.append('AVISO {}: barra {} sin bounding box, no se etiqueta.'.format(tname, r.Id.Value))
                                continue
                            centro = XYZ((bb.Min.X + bb.Max.X) / 2.0, (bb.Min.Y + bb.Max.Y) / 2.0, (bb.Min.Z + bb.Max.Z) / 2.0)
                            # Posicion HACIA AFUERA del assembly (2026-07-15, mismo pedido que el
                            # Multi-Rebar Annotation): el Rebar Tag se colocaba en 'centro' (el propio
                            # centro de la barra, dentro del assembly) - se empuja con
                            # posicion_afuera_assembly, usando la TANGENTE de la barra (no la
                            # perpendicular como el Multi-Rebar: un Rebar Tag no tiene la restriccion de
                            # perpendicularidad de Revit, asi que se empuja de costado a la barra misma,
                            # con el mismo leader (addLeader=True) conectandolo de vuelta). Si no se
                            # puede calcular la tangente (geometria rara), se etiqueta igual en 'centro'
                            # como antes, sin fallar.
                            tangente_tag = tangente_barra_en_plano(r, vplan)
                            empuje_vertical_tag = True
                            if tangente_tag is not None:
                                off_plan_tag = offset_mm / 304.8 * vplan.Scale
                                centro, empuje_vertical_tag, _perp_tag = posicion_afuera_assembly(centro, tangente_tag, vplan, off_plan_tag)
                            # Texto vertical cuando queda a la izquierda (2026-07-20, mismo criterio que
                            # el Multi-Rebar Annotation, ver posicion_afuera_assembly): a diferencia de
                            # ese, IndependentTag.Create recibe el TagOrientation directo al crear el
                            # tag, sin necesidad de ir a buscarlo despues via TagId.
                            orientacion_tag = TagOrientation.Horizontal if empuje_vertical_tag else TagOrientation.Vertical
                            creado = False
                            errores_ref = []
                            for ref_tag, desc_ref in referencias_para_tag(r, vplan):
                                try:
                                    IndependentTag.Create(doc, tag_type_arm.Id, vplan.Id, ref_tag, True, orientacion_tag, centro)
                                    total += 1
                                    log.append('OK {}: tag de armadura ({} / {} -> {}) creado en planta (via {}).'.format(
                                        tname, layout_txt, partition_val, tipo_nombre, desc_ref))
                                    creado = True
                                    break
                                except Exception as e:
                                    errores_ref.append('{}: {}'.format(desc_ref, str(e).splitlines()[0][:120]))
                            if not creado:
                                log.append('ERROR {} tag de armadura (barra {}): ninguna referencia funciono [{}]'.format(tname, r.Id.Value, ' | '.join(errores_ref) if errores_ref else 'sin candidatos'))
                        except Exception as e:
                            log.append('ERROR {} tag de armadura (barra {}): {}'.format(tname, r.Id.Value, e))
                    if pedestal_saltadas:
                        log.append('{}: {} barras de pedestal sin etiquetar en la planta ({} pedestales en el assembly).'.format(tname, pedestal_saltadas, len(pedestales_ai)))
                    if partition_saltadas:
                        log.append('{}: {} barras sin etiquetar en la planta (Partition fuera de {}).'.format(tname, partition_saltadas, sorted(PARTITIONS_TAGEABLES)))
                    if multirebar_creadas:
                        log.append('{}: {} Multi-Rebar Annotations creadas en la planta (barras en modo primera-y-ultima).'.format(tname, multirebar_creadas))
                # ---------- Tags de familias (ex-05, integrado 2026-07-15) ----------
                # Multi-Category Tag a cada FamilyInstance de PRIMER NIVEL del assembly
                # (las anidadas se saltan, tienen SuperComponent), SOLO si el assembly
                # tiene 2+ TIPOS distintos de C-Pedestal (mismo criterio que los
                # callouts de 00: estos tags existen para distinguir pedestales entre
                # si; con 0, 1 o varios del MISMO tipo no se tagea nada). Idempotente:
                # se salta si la planta ya tiene algun Multi-Category Tag (los Rebar
                # Tags de arriba son otra categoria, no cuentan).
                if tag_type_familias is not None:
                    tipos_ped = tipos_pedestal(ai)
                    if len(tipos_ped) < 2:
                        log.append('{}: {} tipo(s) de C-Pedestal (se requieren 2+ distintos), planta sin tags de familias.'.format(tname, len(tipos_ped)))
                    elif has_tags(vplan):
                        log.append('{}: la planta ya tiene tags de familias, se salta.'.format(tname))
                    else:
                        n_fam = 0
                        omitidas_fam = 0
                        for mid in ai.GetMemberIds():
                            el = doc.GetElement(mid)
                            if el is None or el.Category is None or not isinstance(el, FamilyInstance):
                                continue
                            sup = None
                            try:
                                sup = el.SuperComponent
                            except Exception:
                                pass
                            if sup is not None:
                                continue
                            try:
                                bb = el.get_BoundingBox(None)
                                if bb is None:
                                    continue
                                centro_fam = XYZ((bb.Min.X + bb.Max.X) / 2.0, (bb.Min.Y + bb.Max.Y) / 2.0, (bb.Min.Z + bb.Max.Z) / 2.0)
                                IndependentTag.Create(doc, tag_type_familias.Id, vplan.Id, Reference(el), False, TagOrientation.Horizontal, centro_fam)
                                n_fam += 1
                            except Exception:
                                omitidas_fam += 1
                        total += n_fam
                        msg_fam = 'OK {}: {} tags de familias en la planta ({} tipos de C-Pedestal).'.format(tname, n_fam, len(tipos_ped))
                        if omitidas_fam:
                            msg_fam += ' {} familias no admiten este tag.'.format(omitidas_fam)
                        log.append(msg_fam)
            # ---------- CALLOUTS DE PEDESTAL: notas de recuento ----------
            # (2026-07-28) Una nota arriba a la derecha con el recuento de PPL-PPL y otra
            # arriba a la izquierda con el de estribos SEC-EST, ambas seguidas del
            # ITEM_TBL de esa marca. Ver notas_recuento_callout(). Solo callouts de
            # pedestal: la planta y los cortes no llevan estas notas.
            prefijo_ped_callout = tname + PREFIJO_PEDESTAL
            for vname_ped in sorted(nm for nm in views if nm.startswith(prefijo_ped_callout)):
                try:
                    total += notas_recuento_callout(views[vname_ped], tname, barras_ai)
                except Exception as e:
                    log.append('ERROR {} notas de recuento en {}: {}'.format(tname, vname_ped, e))

            # ---------- CORTES A y B ----------
            # ya no se acota la altura en cadena (2026-07-21, pedido de Javier: eran
            # unas cotas azules que no deberian aparecer, senalando la zapata y el
            # pedestal - ver README). El corte solo recibe la Multi-Rebar Annotation
            # de mas abajo.

            for suf, nombre_corte in ((SUFIJO_CORTE, 'corte A'), (SUFIJO_CORTE_B, 'corte B')):
                vsec = views.get(tname + suf)
                if vsec is None:
                    log.append('AVISO {}: no existe la vista de {} (corre 01_Vistas de assembly).'.format(tname, nombre_corte))
                    continue
                # --- Multi-Rebar Annotation en el corte: mismo tratamiento 'primera y
                # ultima barra' que la planta (SetPresentationMode FirstLast + Multi-
                # Rebar Annotation), pedido 2026-07-21. A diferencia de la planta, aca
                # NO se filtra por Partition ni se excluye armadura de pedestal - los
                # cortes ya muestran toda la armadura del assembly a proposito (ver
                # README). Solo Layout == Number with Spacing y CanApplyPresentationMode
                # en ESTA vista (el modo es un estado por VISTA - 00 solo lo aplica en
                # la planta, aca hay que aplicarlo tambien para el corte). Posicion:
                # reusa posicion_afuera_assembly (misma funcion que la planta, sin
                # modificarla) - empuja siempre a la izquierda los sets cuya linea de
                # cota es vertical (ej. estribos de pedestal separados a lo largo de la
                # altura) y siempre arriba los que dan linea de cota horizontal (ej.
                # barras de zapata separadas a lo ancho).
                if tag_type_multirebar is not None and barras_ai:
                    ya_anotadas_multi_corte = elementos_ya_anotados_multirebar(vsec)
                    multirebar_corte_creadas = 0
                    # rango vertical (proyeccion sobre UpDirection) + banda X de cada
                    # anotacion izquierda ya colocada en ESTE corte, para escalonar las
                    # que choquen (ver constantes ..._MULTIREBAR_CORTE_MM). Bandas separadas para
                    # izquierda, derecha (pedestal especifico, ver mas abajo) y arriba -
                    # cada familia de empuje escalona independiente de las demas.
                    bandas_izq_corte = []
                    bandas_der_corte = []
                    bandas_arriba_corte = []
                    for r in barras_ai:
                        if r.Id.Value in ya_anotadas_multi_corte:
                            continue
                        try:
                            si_aplica_corte = r.CanApplyPresentationMode(vsec)
                        except Exception:
                            si_aplica_corte = False
                        if not si_aplica_corte:
                            continue
                        layout_txt_corte, _err_layout_corte = leer_layout_rule(r)
                        if layout_txt_corte is None or layout_txt_corte.strip().lower() != 'number with spacing':
                            continue
                        try:
                            if r.GetPresentationMode(vsec) != RebarPresentationMode.FirstLast:
                                r.SetPresentationMode(vsec, RebarPresentationMode.FirstLast)
                        except Exception as e:
                            log.append('ERROR {} {}: no se pudo aplicar primera-y-ultima barra (barra {}): {}'.format(tname, nombre_corte, r.Id.Value, e))
                            continue
                        try:
                            bb_multi_corte = r.get_BoundingBox(vsec) or r.get_BoundingBox(None)
                            if bb_multi_corte is None:
                                log.append('AVISO {} {}: barra {} sin bounding box, Multi-Rebar Annotation omitida.'.format(tname, nombre_corte, r.Id.Value))
                                continue
                            centro_multi_corte = XYZ((bb_multi_corte.Min.X + bb_multi_corte.Max.X) / 2.0, (bb_multi_corte.Min.Y + bb_multi_corte.Max.Y) / 2.0, (bb_multi_corte.Min.Z + bb_multi_corte.Max.Z) / 2.0)
                            dir_multi_corte, via_dir_corte = direccion_cota_multirebar(r, vsec)
                            if dir_multi_corte is None:
                                log.append('AVISO {} {}: barra {} sin direccion de distribucion calculable, Multi-Rebar Annotation omitida.'.format(tname, nombre_corte, r.Id.Value))
                                continue
                            off_plan_corte = offset_mm / 304.8 * vsec.Scale
                            posicion_multi_corte, empuje_vertical_multi_corte, perp_multi_corte = posicion_afuera_assembly(centro_multi_corte, dir_multi_corte, vsec, off_plan_corte)
                            if not empuje_vertical_multi_corte:
                                # EMPUJE A LA IZQUIERDA O DERECHA (2026-07-21, pedido de Javier: las
                                # anotaciones se montaban unas sobre otras y sobre la zapata).
                                # (a) arrancar POR FUERA del borde del assembly (clearance
                                # positivo, no el offset_mm negativo por defecto que las
                                # dejaba adentro, sobre el hormigon); (b) escalonar: si la
                                # altura del TEXTO de esta barra choca con una anotacion ya
                                # colocada en la misma banda, correrla un paso mas hacia
                                # afuera hasta quedar libre.
                                # LADO (2026-07-21, mismo dia, pedido de Javier: "en cortes con
                                # 2+ pedestales, las cotas de ambos se van hacia la izquierda y
                                # se juntan - dejar mas cerca de los pedestales a las que le
                                # corresponden para que se vea mas equilibrada la vista"): si el
                                # assembly tiene 2+ pedestales (pedestal_ids_ai) y esta barra
                                # resuelve a uno especifico (resolver_pedestal_de_barra), se
                                # empuja hacia el lado de ESE pedestal (lado_derecho_pedestal_en_
                                # corte, comparando cada pedestal contra el promedio de todos en
                                # el eje RightDirection de este corte) en vez de siempre a la
                                # izquierda. Barras sin pedestal resuelto (ej. zapata) o
                                # assemblies con 0/1 pedestal siguen con el criterio fijo de
                                # siempre a la izquierda (sin cambios de comportamiento ahi).
                                off_clear_corte = clearance_tags_corte_mm / 304.8 * vsec.Scale
                                usar_derecha_corte = False
                                if pedestal_ids_ai:
                                    pedestal_barra_id = resolver_pedestal_de_barra(r, pedestal_ids_ai)
                                    if pedestal_barra_id is not None:
                                        usar_derecha_corte = lado_derecho_pedestal_en_corte(pedestal_barra_id, pedestales_ai, vsec)
                                if usar_derecha_corte:
                                    posicion_multi_corte, perp_multi_corte = empuje_derecha_corte(centro_multi_corte, dir_multi_corte, vsec, off_clear_corte)
                                    bandas_lado_corte = bandas_der_corte
                                else:
                                    posicion_multi_corte, _ev_clear, perp_multi_corte = posicion_afuera_assembly(centro_multi_corte, dir_multi_corte, vsec, off_clear_corte)
                                    bandas_lado_corte = bandas_izq_corte
                                up_corte = vsec.UpDirection
                                # banda de choque basada en la ALTURA DEL TEXTO (centro de
                                # la barra = donde queda el tag), NO en la extension completa
                                # de la barra (2026-07-21, fix: los sets verticales largos -
                                # estribos de pedestal, bbox de z=0 a toda la altura - tapaban
                                # TODA la columna izquierda y empujaban lejos a los tags de la
                                # zapata, que estan abajo, aunque sus TEXTOS no se pisaran por
                                # estar a alturas muy distintas. Confirmado por Javier: pasa solo
                                # en assemblies con 2+ familias a distinta altura, ej. pedestal +
                                # zapata; con una sola familia estaba bien). Dos tags chocan solo
                                # si sus textos (centro +- MARGEN) se solapan verticalmente.
                                centro_v = centro_multi_corte.DotProduct(up_corte)
                                margen_v = MARGEN_MULTIREBAR_CORTE_MM / 304.8 * vsec.Scale
                                v_lo = centro_v - margen_v
                                v_hi = centro_v + margen_v
                                banda = 0
                                while True:
                                    choca = False
                                    for (o_lo, o_hi, o_b) in bandas_lado_corte:
                                        if o_b == banda and not (v_hi < o_lo or v_lo > o_hi):
                                            choca = True
                                            break
                                    if not choca:
                                        break
                                    banda += 1
                                if banda > 0:
                                    paso_corte = paso_tags_corte_mm / 304.8 * vsec.Scale
                                    posicion_multi_corte = posicion_multi_corte.Add(perp_multi_corte.Multiply(banda * paso_corte))
                                bandas_lado_corte.append((v_lo, v_hi, banda))
                            else:
                                # EMPUJE HACIA ARRIBA (2026-07-21, mismo pedido: los sets
                                # horizontales -barras de zapata separadas a lo ancho- se
                                # amontonaban a la misma altura cuando habia varios en el mismo
                                # corte, con el texto ilegible, superpuesto). Mismo escalonado
                                # que la izquierda/derecha pero con los ejes cruzados: la banda
                                # de choque se mide por posicion HORIZONTAL (RightDirection) en
                                # vez de vertical, y el paso se aplica hacia ARRIBA
                                # (perp_multi_corte) en vez de hacia el costado. Mantiene la
                                # posicion original de posicion_afuera_assembly (offset_mm, no
                                # clearance_tags_corte_mm que es solo para izquierda/derecha) -
                                # antes de este fix el empuje hacia arriba no escalonaba nada.
                                right_corte = vsec.RightDirection
                                centro_h = centro_multi_corte.DotProduct(right_corte)
                                margen_h = MARGEN_HORIZONTAL_MULTIREBAR_CORTE_MM / 304.8 * vsec.Scale
                                h_lo = centro_h - margen_h
                                h_hi = centro_h + margen_h
                                banda_arriba = 0
                                while True:
                                    choca = False
                                    for (o_lo, o_hi, o_b) in bandas_arriba_corte:
                                        if o_b == banda_arriba and not (h_hi < o_lo or h_lo > o_hi):
                                            choca = True
                                            break
                                    if not choca:
                                        break
                                    banda_arriba += 1
                                if banda_arriba > 0:
                                    paso_corte = paso_tags_corte_mm / 304.8 * vsec.Scale
                                    posicion_multi_corte = posicion_multi_corte.Add(perp_multi_corte.Multiply(banda_arriba * paso_corte))
                                bandas_arriba_corte.append((h_lo, h_hi, banda_arriba))
                            # Tipo de Multi-Rebar Annotation segun RebarShape.RebarStyle
                            # (2026-07-21, solo en cortes): estribos/amarras (StirrupTie)
                            # usan NOMBRE_TIPO_MULTIREBAR_ESTRIBO; el resto sigue con el
                            # tipo general. Si el tipo de estribo no existe en el proyecto,
                            # cae de vuelta al general (ya avisado en el bootstrap).
                            tipo_multi_corte = tag_type_multirebar
                            try:
                                if tag_type_multirebar_estribo is not None and es_estribo_stirrup_tie(r):
                                    tipo_multi_corte = tag_type_multirebar_estribo
                            except Exception as e:
                                log.append('AVISO {} {}: no se pudo evaluar RebarStyle (barra {}): {}'.format(tname, nombre_corte, r.Id.Value, e))
                            opciones_multi_corte = MultiReferenceAnnotationOptions(tipo_multi_corte)
                            opciones_multi_corte.SetElementsToDimension(List[ElementId]([r.Id]))
                            opciones_multi_corte.TagHasLeader = True
                            opciones_multi_corte.DimensionPlaneNormal = vsec.ViewDirection
                            opciones_multi_corte.DimensionLineDirection = dir_multi_corte
                            opciones_multi_corte.DimensionLineOrigin = posicion_multi_corte
                            opciones_multi_corte.TagHeadPosition = posicion_multi_corte
                            ann_multi_corte = MultiReferenceAnnotation.Create(doc, vsec.Id, opciones_multi_corte)
                            if not empuje_vertical_multi_corte:
                                try:
                                    tag_multi_corte = doc.GetElement(ann_multi_corte.TagId)
                                    if tag_multi_corte is not None:
                                        tag_multi_corte.TagOrientation = TagOrientation.Vertical
                                except Exception as e:
                                    log.append('AVISO {} {}: no se pudo rotar el texto del Multi-Rebar Annotation (barra {}): {}'.format(tname, nombre_corte, r.Id.Value, e))
                            total += 1
                            multirebar_corte_creadas += 1
                            log.append('OK {}: Multi-Rebar Annotation creada en {} (barra {}, direccion via {}).'.format(tname, nombre_corte, r.Id.Value, via_dir_corte))
                        except Exception as e:
                            log.append('ERROR {} {} Multi-Rebar Annotation (barra {}): {}'.format(tname, nombre_corte, r.Id.Value, e))
                    if multirebar_corte_creadas:
                        log.append('{}: {} Multi-Rebar Annotations creadas en {} (barras Number with Spacing en modo primera-y-ultima).'.format(tname, multirebar_corte_creadas, nombre_corte))

                # --- CADENA VERTICAL DE COBERTURA en el corte (re-implementada 2026-07-25,
                #     pedido de Javier). Va DESPUES de las anotaciones: reusa que quedan en
                #     modo primera-y-ultima y su idempotencia excluye las Dimensions de las
                #     anotaciones (por eso el doc.Regenerate antes, para poblar DimensionId).
                if barras_ai:
                    try:
                        doc.Regenerate()
                        total += crear_cadena_vertical_corte(vsec, faces, barras_ai, tname, offset_mm)
                    except Exception as e:
                        log.append('ERROR {} {} cadena vertical de cobertura: {}'.format(tname, nombre_corte, e))
        except Exception as e:
            log.append('ERROR {}: {}'.format(tname, e))
finally:
    TransactionManager.Instance.TransactionTaskDone()

log.insert(0, 'Anotaciones creadas: {} | assemblies procesados: {}'.format(total, len(targets)))
OUT = log
# ----------------------------------------
log = Watch(py_cotas_generales_spot)  # graph output
