# Dynamo graph 05_Tabla de assemblies.dyn (Dynamo 4.0.2.3852)
# PASO 6 de 6 - Crea en cada lamina la tabla de despiece de armaduras: una fila por marca, agrupada por fundacion, con diametro, cantidad, largos y pesos. Requiere los pasos 2 a 4.

sheets_destino_numeros_con_coma = StringInput("")  # "Sheets destino (numeros con coma, o prefijo)"; graph input
margen_mm = IntegerSlider(20, range=5..50 step 1)  # graph input
reserva_lado_derecho_mm = IntegerSlider(150, range=0..200 step 5)  # graph input
estilo_de_linea_grid_outline = StringInput("Líneas Tablas Finas")  # graph input
tipo_de_texto_encabezados = StringInput("C_TXT_RomanD2.3mm")  # graph input
tipo_de_texto_cuerpo = StringInput("C_TXT_RomanD2.3mm_Negrita")  # graph input
titulo_de_la_tabla = StringInput("")  # graph input
view_template_para_las_tablas = StringInput("TABLA_ARMADURAS_TIPO")  # graph input
py_tabla_de_assemblies_por_sheet = Python(IN[0]=sheets_destino_numeros_con_coma, IN[1]=margen_mm, IN[2]=reserva_lado_derecho_mm, IN[3]=estilo_de_linea_grid_outline, IN[4]=tipo_de_texto_encabezados, IN[5]=tipo_de_texto_cuerpo, IN[6]=titulo_de_la_tabla, IN[7]=view_template_para_las_tablas)  # PythonNet3
# ---------- py_tabla_de_assemblies_por_sheet.python (648 lines) ----------
# 06_Tabla de assemblies - Crea, por cada sheet destino, un schedule nativo de Revit
# de categoria STRUCTURAL REBAR con la tabla de despiece de armaduras de los assemblies
# documentados en ESE sheet. Estructura (igual que la planilla a mano de referencia):
#   Encabezado nivel 1 = nombre del assembly ("FUNDACION FN-1001", de ELEMENTO_TBL)
#   Encabezado nivel 2 = "CANT=N" (cantidad de instancias de ese tipo de fundacion)
#   Una fila por MARCA (ITEM_TBL) con: TIPO / Diametro / CANTIDAD TOTAL BARRAS /
#   A..F (mm) / UNIT (m) / TOTAL (m) / PESO UNITARIO (Kg) / PESO TOTAL (Kg) / OBSERVACION.
#
# Reglas de negocio (definidas por el usuario, confirmadas contra el modelo real):
# - Solo se consideran BARRAS (elementos nativos Structural Rebar). Nada de hormigones ni
#   pernos (eso era la version anterior de esta tabla, multi-categoria).
# - Las barras se agrupan por ASSEMBLY (una tabla por sheet, un bloque por tipo de
#   fundacion documentado en ese sheet) y dentro por MARCA = ITEM_TBL.
# - MARCA = ITEM_TBL ; TIPO = nombre de la RebarShape (ej. "TIPO-3") ; Diametro (mm) =
#   Bar Diameter ; A..F (mm) = parametros compartidos A..F de la barra.
# - CANTIDAD TOTAL BARRAS = suma de 'Quantity' (nro de barras del set) de todas las barras
#   que colapsan en la fila (misma marca Y misma geometria) dentro del assembly. La suma
#   la hace Revit, no este script (campo nativo con DisplayType=Totals).
# - UNIT (m) = A+B+C+D+E+F. NO es el 'Bar Length' de Revit, que descuenta el desarrollo de
#   los dobleces (~2,6% menos). Criterio confirmado con jefatura el 2026-08-05.
# - TOTAL (m) = UNIT x Quantity, sumado sobre las barras que colapsan en la fila.
# - PESO UNIT. (Kg) = UNIT x 'Bar Mass per Unit Length' del tipo de barra. Ese parametro
#   nativo de Revit coincide con la formula de BIOS (Diam_mm^2 * 0.617/100) dentro del
#   0,1% -- Revit usa la densidad exacta del acero y BIOS el 0,00617 redondeado.
# - PESO TOTAL (Kg) = PESO UNIT. x Quantity, sumado igual que TOTAL.
# - OBSERVACION = parametro Comments de la barra.
# - Cuando dos barras de una misma marca NO son identicas en lo que se muestra (ej. la
#   marca 1609, que agrupa a proposito la barra SUP. y la INF. con tramos distintos), la
#   marca sale en una fila por variante. Antes esas celdas decian "<varies>"; con campos
#   nativos no se pueden homogeneizar sin romper el colapso del schedule.
#
# Mecanica (reescrita 2026-08-05: la tabla entera pasa a ser VIVA):
# - TODAS las columnas se actualizan solas cuando el modelador edita la armadura, SIN
#   correr este graph. Ya no se precalcula ni se escribe ningun valor de la tabla.
# - Las columnas salen de dos lados:
#     * campos NATIVOS / compartidos de la barra (MARCA=ITEM_TBL, TIPO, Diametro,
#       CANTIDAD, A..F, OBSERVACION). A..F son los parametros reales de la RebarShape.
#     * VALORES CALCULADOS (UNIT / TOTAL / PESO UNIT. / PESO TOTAL), que son formulas
#       dentro del schedule.
# - La API de Revit NO puede crear valores calculados. Por eso las columnas, su orden, sus
#   unidades, la agrupacion y las 4 formulas viven en un VIEW TEMPLATE de schedule que se
#   arma UNA vez a mano (ver 99_Crear tabla base ARMADURAS). Este graph ya no construye
#   campos: crea el schedule, le aplica el template y le pone el filtro de la lamina.
#   El template DEBE tener marcado el Include de "Fields" y NO el de "Filter".
# - CANTIDAD, TOTAL y PESO TOTAL son campos con DisplayType=Totals: el schedule
#   (IsItemized=False) suma las barras que colapsan en la fila en vez de partirla.
# - Se REUSAN los compartidos ya existentes: ITEM_TBL (MARCA), A..F, ELEMENTO_TBL (texto
#   del encabezado de assembly) y SHEET_ARMADURAS (filtro PROPIO de ARMADURAS - NO se usa
#   Comments, que es el filtro de las tablas de la rutina de Formas sobre los MISMOS
#   elementos fisicos). Los unicos ARM_* que sobreviven son ARM_L1 y ARM_L2, los dos
#   encabezados de agrupacion: son lo unico que el script sabe y Revit no puede deducir.
# - Asociacion barra -> assembly: se recorren los miembros (recursivo) de la PRIMERA
#   instancia de cada tipo que TENGA barras, y se toma toda barra que sea miembro directo
#   o este alojada (GetHostId) en un miembro. Asi se documenta un solo representante por
#   tipo (misma convencion del resto del pipeline) y el CANT=N multiplica aparte.
#
# LIMITACION CONOCIDA: las filas de SUBTOTAL por fundacion de la planilla a mano (suma de
# cantidad / TOTAL(m) / peso) NO se generan: un campo de schedule nativo no puede a la vez
# mostrar el valor por-marca colapsado y sumarse en un pie de grupo. Queda pendiente.
#
# Revit 2027 / Dynamo 4 / CPython3
# IN[0] = sheets destino: numeros separados por coma, o un prefijo comun
# IN[1] = margen (mm), misma convencion que 01/02
# IN[2] = reserva lado derecho (mm) - debe coincidir con 01 y 02
# IN[3] = nombre del estilo de linea para grid/outline del schedule (vacio = no tocar)
# IN[4] = nombre del tipo de texto para encabezados (vacio = no tocar)
# IN[5] = nombre del tipo de texto para el cuerpo (vacio = no tocar)
# IN[6] = titulo de la tabla (se aplica a TODAS las tablas creadas; vacio = titulo en blanco)
# IN[7] = nombre del view template de schedule con las columnas y las formulas.
#         OBLIGATORIO: sin el no hay tabla. Es el que se guardo desde la tabla base
#         (TABLA_ARMADURAS_TIPO), NO el TABLA_TIPO de la rutina de Formas.

import clr
clr.AddReference('RevitAPI')
clr.AddReference('RevitServices')
from Autodesk.Revit.DB import (FilteredElementCollector, AssemblyInstance, ViewSheet,
                               ScheduleSheetInstance, ViewSchedule, ScheduleFilter,
                               ScheduleFilterType, ScheduleSortGroupField, BuiltInCategory,
                               BuiltInParameter, ElementId, XYZ, Element, TextNoteType,
                               GraphicsStyle, StorageType, FamilyInstance, SharedParameterElement,
                               ParameterFilterRuleFactory, ElementParameterFilter,
                               ExternalDefinitionCreationOptions, SpecTypeId, CategoryType, GroupTypeId)
from Autodesk.Revit.DB.Structure import Rebar
from RevitServices.Persistence import DocumentManager
from RevitServices.Transactions import TransactionManager
from System import Guid
import os
import tempfile

doc = DocumentManager.Instance.CurrentDBDocument

sheets_text = (IN[0] or '').strip()
margin = float(IN[1]) / 304.8
right_reserve = float(IN[2]) / 304.8
grid_style_name = (IN[3] or '').strip()
header_text_name = (IN[4] or '').strip()
body_text_name = (IN[5] or '').strip()
titulo_tabla = (IN[6] or '').strip()
template_nombre = (IN[7] or '').strip()

# --- GUIDs de parametros compartidos YA EXISTENTES en el proyecto ---
GUID_ELEMENTO_TBL = Guid('433e7c25-aa15-4380-9474-c6dffa787fa2')  # ELEMENTO_TBL -> "FUNDACION FN-xxxx"

SUFIJO_ARMADURAS = ' - ARMADURA'
NOMBRE_PARAM_SHEET_ARM = 'SHEET_ARMADURAS'
PREFIJO_SCHEDULE = 'TBL_ARMADURAS_'
REBAR_CAT_ID = ElementId(BuiltInCategory.OST_Rebar)

# Unicos ARM_* que sobreviven: los dos encabezados de agrupacion y el multiplicador de
# assemblies. Todo lo demas lo resuelve el template (columnas + formulas) o el propio Revit
# (campos nativos de la barra).
# OJO: ARM_TIPO, ARM_DIAM, ARM_CANT, ARM_A..ARM_F, ARM_OBS, ARM_UNIT, ARM_TOTAL,
# ARM_PESO_U y ARM_PESO_T ya NO se usan. En proyectos que vienen de corridas viejas siguen
# existiendo con su ultimo valor escrito, pero ninguna tabla los mira.
NOMBRE_CANT_ASSY = 'ARM_CANT_ASSY'
NOMBRES_ARM = ['ARM_L1', 'ARM_L2', NOMBRE_CANT_ASSY]
# ARM_CANT_ASSY es ENTERO, no texto: las formulas de TOTAL (m) y PESO TOTAL (Kg) del
# template lo usan como multiplicador (cantidad de assemblies del tipo). El encabezado
# ARM_L2 lleva el mismo numero pero como texto ("CANT=3"), y el texto no sirve en una
# formula de Revit -- de ahi que haya que escribir los dos.
SPECS_ARM = {NOMBRE_CANT_ASSY: SpecTypeId.Int.Integer}

# GUIDs CANONICOS de los compartidos que crea este pipeline. Son fijos a proposito: la
# identidad de un parametro compartido es el GUID, no el nombre. Si se dejaran al azar (que
# es lo que pasaba antes), cada proyecto nuevo generaria GUIDs distintos y el view template
# transferido apuntaria a parametros que en ese proyecto no existen -> columnas vacias.
# Los tres primeros son los que ya tenia el modelo de prueba; se respetan tal cual.
GUIDS_CANONICOS = {
    'SHEET_ARMADURAS': Guid('f13e5924-2e85-4b1d-a5ec-ed90ba914a21'),
    'ARM_L1': Guid('c1ac69e4-5005-4849-8952-f14e2101cf20'),
    'ARM_L2': Guid('59d4055b-b7b5-4125-bdf7-52ffd41649c5'),
    'ARM_CANT_ASSY': Guid('8f890889-5f44-43a0-8cbf-83f5d06f2474'),
}
# el archivo de definiciones es solo el vehiculo para crearlos; con los GUID fijos da igual
# que %TEMP% se limpie, que era la fragilidad original
ARCHIVO_COMPARTIDOS = 'bios_params_armaduras_v2.txt'

log = []


def elem_name(e):
    try:
        return e.Name
    except Exception:
        return Element.Name.__get__(e)


def as_str(p):
    if p is None:
        return ''
    try:
        return p.AsString() or ''
    except Exception:
        return ''


def rebar_elemento(r):
    return as_str(r.get_Parameter(GUID_ELEMENTO_TBL)).strip()


# --- sheets destino (misma logica que 03_Colocar vistas en laminas) ---
all_sheets = {}
for s in FilteredElementCollector(doc).OfClass(ViewSheet):
    all_sheets[s.SheetNumber] = s

target_sheets = []
seen = set()
for tok in [t.strip() for t in sheets_text.split(',') if t.strip()]:
    if tok in all_sheets:
        matches = [all_sheets[tok]]
    else:
        matches = [s for n, s in all_sheets.items() if n.startswith(tok)]
    for s in matches:
        if s.SheetNumber not in seen:
            seen.add(s.SheetNumber)
            target_sheets.append(s)
target_sheets.sort(key=lambda s: s.SheetNumber)

if not target_sheets:
    log.append('ERROR: ningun sheet coincide con "{}".'.format(sheets_text))
    log.append('Sheets del proyecto: ' + ', '.join(sorted(all_sheets.keys())[:30]))
    OUT = log
else:
    by_type = {}
    for ai in FilteredElementCollector(doc).OfClass(AssemblyInstance):
        by_type.setdefault(ai.AssemblyTypeName, []).append(ai)

    # cache de todas las barras del modelo con su host, para asociarlas a assemblies
    todas_barras = list(FilteredElementCollector(doc).OfCategory(BuiltInCategory.OST_Rebar)
                        .WhereElementIsNotElementType().ToElements())
    host_de_barra = {}
    for r in todas_barras:
        try:
            hid = r.GetHostId()
            host_de_barra[r.Id.Value] = hid.Value if hid is not None else None
        except Exception:
            host_de_barra[r.Id.Value] = None

    def member_ids_recursivos(ai):
        ids = set()
        stack = list(ai.GetMemberIds())
        while stack:
            eid = stack.pop()
            if eid.Value in ids:
                continue
            ids.add(eid.Value)
            el = doc.GetElement(eid)
            if isinstance(el, FamilyInstance):
                try:
                    for s in el.GetSubComponentIds():
                        stack.append(s)
                except Exception:
                    pass
        return ids

    def barras_de_assembly(ai):
        ids = member_ids_recursivos(ai)
        res = []
        for r in todas_barras:
            if r.Id.Value in ids or host_de_barra.get(r.Id.Value) in ids:
                res.append(r)
        return res

    def representante_con_barras(tname):
        # primera instancia del tipo que tenga barras asociadas (si ninguna, la primera)
        for cand in by_type.get(tname, []):
            bs = barras_de_assembly(cand)
            if bs:
                return cand, bs
        insts = by_type.get(tname, [])
        return (insts[0], []) if insts else (None, [])

    def usable_rect(sheet):
        col = FilteredElementCollector(doc, sheet.Id).OfCategory(BuiltInCategory.OST_TitleBlocks)
        tb = col.FirstElement()
        if tb is not None:
            bb = tb.get_BoundingBox(sheet)
            if bb is not None:
                return (bb.Min.X + margin, bb.Min.Y + margin,
                        bb.Max.X - margin - right_reserve, bb.Max.Y - margin)
        o = sheet.Outline
        return (o.Min.U + margin, o.Min.V + margin,
                o.Max.U - margin - right_reserve, o.Max.V - margin)

    # --- que tipos de assembly hay colocados en cada sheet destino (solo plantas ARMADURA) ---
    tipos_por_sheet = {}
    for sh in target_sheets:
        tipos = set()
        for vpid in sh.GetAllViewports():
            vp = doc.GetElement(vpid)
            v = doc.GetElement(vp.ViewId)
            n = elem_name(v)
            if not n.endswith(SUFIJO_ARMADURAS):
                continue
            base = n[:-len(SUFIJO_ARMADURAS)]
            if base in by_type:
                tipos.add(base)
        if tipos:
            tipos_por_sheet[sh.SheetNumber] = (sh, tipos)

    if not tipos_por_sheet:
        log.append('Ningun sheet destino tiene plantas de assembly (ARMADURA) colocadas todavia.')
        log.append('Corre 00 / 01 / 02 primero.')
        OUT = log
    else:
        estilos_linea = list(FilteredElementCollector(doc).OfClass(GraphicsStyle))
        tipos_texto = list(FilteredElementCollector(doc).OfClass(TextNoteType))

        def buscar_por_nombre(coleccion, nombre, etiqueta):
            if not nombre:
                return None
            low = nombre.lower()
            for e in coleccion:
                if elem_name(e).lower() == low:
                    return e
            log.append('AVISO: no se encontro {} "{}"; se deja el valor por defecto.'.format(etiqueta, nombre))
            return None

        estilo_grid = buscar_por_nombre(estilos_linea, grid_style_name, 'el estilo de linea')
        tipo_header = buscar_por_nombre(tipos_texto, header_text_name, 'el tipo de texto de encabezados')
        tipo_body = buscar_por_nombre(tipos_texto, body_text_name, 'el tipo de texto de cuerpo')

        # El template NO es opcional: es donde viven las columnas y las 4 formulas, que la
        # API de Revit no puede crear. Sin el, la tabla saldria vacia.
        templates_schedule = [v for v in FilteredElementCollector(doc).OfClass(ViewSchedule) if v.IsTemplate]
        template_tabla = None
        low_t = template_nombre.lower()
        if low_t:
            template_tabla = next((v for v in templates_schedule if elem_name(v).lower() == low_t), None)
        if template_tabla is None:
            log.append('ERROR: no se encontro el view template de schedule "{}".'.format(template_nombre))
            log.append('Es obligatorio: ahi viven las columnas y las formulas de UNIT / TOTAL /')
            log.append('PESO UNIT. / PESO TOTAL. Se arma una vez con 99_Crear tabla base ARMADURAS.')
            disponibles = sorted(elem_name(v) for v in templates_schedule)
            log.append('Templates de schedule disponibles: ' + (', '.join(disponibles) or '(ninguno)'))
            tipos_por_sheet = {}

        def buscar_parametro_fuzzy(el, nombre):
            low = nombre.lower().strip()
            try:
                for p in el.Parameters:
                    try:
                        if p.Definition.Name.lower().strip() == low:
                            return p
                    except Exception:
                        continue
            except Exception:
                pass
            return None

        def set_param_by_name(el, nombre, valor):
            try:
                p = buscar_parametro_fuzzy(el, nombre)
                if p is None or p.IsReadOnly:
                    return False
                if p.StorageType == StorageType.ElementId:
                    p.Set(valor.Id if hasattr(valor, 'Id') else valor)
                elif p.StorageType == StorageType.Integer:
                    p.Set(int(valor))
                elif p.StorageType == StorageType.String:
                    p.Set(str(valor))
                else:
                    return False
                return True
            except Exception:
                return False

        # --- bootstrap de parametros compartidos (SHEET_ARMADURAS + ARM_*) ---
        guids_arm = {}   # nombre -> Guid
        guid_sheet_arm = [None]  # lista para poder mutar desde funcion anidada

        def cat_rebar():
            try:
                return doc.Settings.Categories.get_Item(BuiltInCategory.OST_Rebar)
            except Exception:
                return None

        def asegurar_binding_rebar(definition):
            # asegura que 'definition' este enlazada (instancia) a la categoria Rebar,
            # preservando las categorias que ya tuviera (para SHEET_ARMADURAS, que ya
            # existe enlazada a otras categorias de la corrida vieja).
            app = doc.Application
            rebar_c = cat_rebar()
            if rebar_c is None:
                return
            bmap = doc.ParameterBindings
            it = bmap.ForwardIterator()
            it.Reset()
            binding_existente = None
            while it.MoveNext():
                d = it.Key
                if d is not None and d.Name == definition.Name:
                    binding_existente = it.Current
                    break
            cats = app.Create.NewCategorySet()
            ya = False
            if binding_existente is not None:
                for c in binding_existente.Categories:
                    cats.Insert(c)
                    if c.Id.Value == rebar_c.Id.Value:
                        ya = True
            if ya:
                return
            cats.Insert(rebar_c)
            binding = app.Create.NewInstanceBinding(cats)
            if binding_existente is not None:
                bmap.ReInsert(definition, binding, GroupTypeId.Data)
            else:
                bmap.Insert(definition, binding, GroupTypeId.Data)

        def asegurar_params():
            # crea/ubica SHEET_ARMADURAS y los ARM_*; enlaza todos a la categoria Rebar.
            app = doc.Application
            old_file = app.SharedParametersFilename
            tmp = os.path.join(tempfile.gettempdir(), ARCHIVO_COMPARTIDOS)
            if not os.path.exists(tmp):
                f = open(tmp, 'w')
                f.close()
            app.SharedParametersFilename = tmp
            try:
                deffile = app.OpenSharedParameterFile()
                grupo = None
                for g in deffile.Groups:
                    if g.Name == 'ARMADURAS':
                        grupo = g
                        break
                if grupo is None:
                    grupo = deffile.Groups.Create('ARMADURAS')

                nombres = [NOMBRE_PARAM_SHEET_ARM] + NOMBRES_ARM
                spe_por_nombre = {}
                for spe in FilteredElementCollector(doc).OfClass(SharedParameterElement):
                    spe_por_nombre[elem_name(spe)] = spe

                for nombre in nombres:
                    spe = spe_por_nombre.get(nombre)
                    if spe is None:
                        # aun no existe en el proyecto: definir en el archivo compartido y bindear
                        definicion = grupo.Definitions.get_Item(nombre)
                        if definicion is None:
                            spec = SPECS_ARM.get(nombre, SpecTypeId.String.Text)
                            opts = ExternalDefinitionCreationOptions(nombre, spec)
                            g = GUIDS_CANONICOS.get(nombre)
                            if g is not None:
                                opts.GUID = g
                            definicion = grupo.Definitions.Create(opts)
                        rebar_c = cat_rebar()
                        cats = app.Create.NewCategorySet()
                        if rebar_c is not None:
                            cats.Insert(rebar_c)
                        binding = app.Create.NewInstanceBinding(cats)
                        doc.ParameterBindings.Insert(definicion, binding, GroupTypeId.Data)
                    else:
                        # ya existe: solo asegurar que llegue a la categoria Rebar
                        idef = None
                        try:
                            idef = spe.GetDefinition()
                        except Exception:
                            idef = None
                        if idef is not None:
                            asegurar_binding_rebar(idef)
            finally:
                app.SharedParametersFilename = old_file
            doc.Regenerate()

            # recolectar guids finales
            for spe in FilteredElementCollector(doc).OfClass(SharedParameterElement):
                nombre = elem_name(spe)
                if nombre == NOMBRE_PARAM_SHEET_ARM:
                    guid_sheet_arm[0] = spe.GuidValue
                elif nombre in NOMBRES_ARM:
                    guids_arm[nombre] = spe.GuidValue

            # aviso de portabilidad: si el proyecto ya traia el compartido con otro GUID (de
            # una corrida anterior a los GUID fijos), no se puede cambiar. Funciona aca, pero
            # el view template no se podra transferir limpio a otro proyecto.
            for nombre, g in GUIDS_CANONICOS.items():
                actual = guid_sheet_arm[0] if nombre == NOMBRE_PARAM_SHEET_ARM else guids_arm.get(nombre)
                if actual is not None and str(actual).lower() != str(g).lower():
                    log.append('AVISO: {} existe en este proyecto con GUID {} en vez del canonico {}.'.format(
                        nombre, actual, g))
                    log.append('Funciona aca, pero el template no sera portable. Para normalizarlo hay que')
                    log.append('borrar ese parametro del proyecto (Manage > Project Parameters) y re-correr.')

        existing_schedules = {elem_name(v): v for v in FilteredElementCollector(doc).OfClass(ViewSchedule)}
        existing_sheet_instances = {}
        for ssi in FilteredElementCollector(doc).OfClass(ScheduleSheetInstance):
            existing_sheet_instances.setdefault(ssi.OwnerViewId.Value, []).append(ssi)

        def configurar_schedule(sched, sheet_number):
            # Las columnas, su orden, sus unidades, la agrupacion y las 4 FORMULAS vienen
            # del view template: la API de Revit no puede crear valores calculados, asi que
            # este graph no construye ni un solo campo. Solo aplica el template y le pone
            # el filtro de esta lamina.
            if sched.ViewTemplateId != template_tabla.Id:
                sched.ViewTemplateId = template_tabla.Id
                doc.Regenerate()

            definition = sched.Definition
            if definition.GetFieldCount() == 0:
                log.append('ERROR sheet {}: el template "{}" no le puso ninguna columna a la tabla.'.format(
                    sheet_number, template_nombre))
                log.append('En el template, marca la casilla Include de "Fields": ahi viajan las columnas')
                log.append('y las formulas. Sin eso la tabla sale vacia.')
                return False

            # el campo del filtro tiene que venir en el template (oculto)
            campo_filtro = None
            spe_filtro = SharedParameterElement.Lookup(doc, guid_sheet_arm[0])
            if spe_filtro is not None:
                for fid in definition.GetFieldOrder():
                    f = definition.GetField(fid)
                    if f.ParameterId == spe_filtro.Id:
                        campo_filtro = f
                        break
            if campo_filtro is None:
                log.append('ERROR sheet {}: el template "{}" no incluye el campo {}.'.format(
                    sheet_number, template_nombre, NOMBRE_PARAM_SHEET_ARM))
                log.append('Ese campo (oculto) es el que filtra cada tabla a su lamina. Agregalo a la')
                log.append('tabla base, vuelve a guardar el template y re-corre este graph.')
                return False

            try:
                while definition.GetFilterCount() > 0:
                    definition.RemoveFilter(0)
                definition.AddFilter(ScheduleFilter(campo_filtro.FieldId, ScheduleFilterType.Equal, sheet_number))
            except Exception as e:
                log.append('ERROR sheet {}: no se pudo poner el filtro por lamina: {}'.format(sheet_number, e))
                log.append('Revisa que el template "{}" NO tenga marcado el Include de "Filter":'.format(template_nombre))
                log.append('si el template controla el filtro, todas las tablas mostrarian lo mismo.')
                return False
            doc.Regenerate()

            # Grafismo y titulo. Si el template controla Appearance/Formatting, estos
            # parametros quedan de solo lectura y estas llamadas no hacen nada (a proposito:
            # manda el template).
            if estilo_grid is not None:
                set_param_by_name(sched, 'Grid lines', estilo_grid)
                set_param_by_name(sched, 'Outline', estilo_grid)
            if tipo_header is not None:
                set_param_by_name(sched, 'Header text', tipo_header)
            if tipo_body is not None:
                set_param_by_name(sched, 'Body text', tipo_body)
            set_param_by_name(sched, 'Show Title', 1)
            set_param_by_name(sched, 'Show Headers', 1)

            p_titulo = sched.get_Parameter(BuiltInParameter.VIEW_DESCRIPTION)
            if p_titulo is not None and not p_titulo.IsReadOnly and p_titulo.AsString() != titulo_tabla:
                p_titulo.Set(titulo_tabla)
            return True

        creados = 0
        ya_estaban = 0
        limpiados = 0
        marcadas = 0

        TransactionManager.Instance.EnsureInTransaction(doc)
        try:
            asegurar_params()
            if guid_sheet_arm[0] is None or any(n not in guids_arm for n in NOMBRES_ARM):
                log.append('ERROR: no se pudieron crear/enlazar los parametros compartidos de la tabla. No se creo nada.')
                faltan = [n for n in NOMBRES_ARM if n not in guids_arm]
                if guid_sheet_arm[0] is None:
                    faltan.append(NOMBRE_PARAM_SHEET_ARM)
                log.append('Faltantes: ' + ', '.join(faltan))
                tipos_por_sheet = {}

            def escribir(el, guid, valor):
                p = el.get_Parameter(guid)
                if p is not None and not p.IsReadOnly and p.AsString() != valor:
                    p.Set(valor)

            def escribir_int(el, guid, valor):
                p = el.get_Parameter(guid)
                if p is not None and not p.IsReadOnly and p.AsInteger() != int(valor):
                    p.Set(int(valor))

            for sheet_number, (sh, tipos) in tipos_por_sheet.items():
                # barras legitimas de este sheet (representante de cada tipo)
                barras_por_tipo = {}
                barras_legitimas = set()
                for tname in tipos:
                    ai, barras = representante_con_barras(tname)
                    barras_por_tipo[tname] = (ai, barras)
                    for r in barras:
                        barras_legitimas.add(r.Id.Value)

                # limpieza GLOBAL: cualquier elemento con SHEET_ARMADURAS = este sheet que
                # ya no sea legitimo (barras de corridas viejas, o fundaciones marcadas por
                # la version anterior de esta tabla) se limpia para que no filtre filas.
                regla = ParameterFilterRuleFactory.CreateEqualsRule(
                    SharedParameterElement.Lookup(doc, guid_sheet_arm[0]).Id, sheet_number)
                filtro_global = ElementParameterFilter(regla)
                for el in FilteredElementCollector(doc).WherePasses(filtro_global).WhereElementIsNotElementType().ToElements():
                    if el.Id.Value in barras_legitimas:
                        continue
                    pc_o = el.get_Parameter(guid_sheet_arm[0])
                    if pc_o is not None and not pc_o.IsReadOnly and pc_o.AsString():
                        pc_o.Set('')
                        limpiados += 1

                for tname in tipos:
                    ai, barras = barras_por_tipo[tname]
                    cant_assembly = len(by_type.get(tname, []))
                    cant_str = 'CANT={}'.format(cant_assembly)
                    if not barras:
                        log.append('AVISO: el tipo {} no tiene barras asociadas (sheet {}).'.format(tname, sheet_number))
                        continue

                    # Encabezado nivel 1: tiene que ser UNICO por TIPO de assembly. OJO:
                    # ELEMENTO_TBL es texto que cargan A MANO los modeladores y NO es unico
                    # por tipo - verificado por MCP sobre el modelo real: 132 barras de tipos
                    # de fundacion DISTINTOS comparten "FUNDACION FN-1002". Usarlo tal cual
                    # hacia que dos tipos cayeran bajo el MISMO encabezado y el segundo
                    # apareciera huerfano, mostrando solo su "CANT=N" sin nombre de assembly
                    # (bug reportado por Javier, 2026-07-21). Ahora ELEMENTO_TBL se usa solo
                    # si de verdad corresponde a ESTE tipo (contiene tname); si no, se
                    # reconstruye con su prefijo descriptivo (ej. "FUNDACION") + el nombre
                    # REAL del tipo, que es el unico dato autoritativo.
                    elems = [rebar_elemento(r) for r in barras if rebar_elemento(r)]
                    elem_txt = elems[0] if elems else ''
                    if elem_txt and tname in elem_txt:
                        header_l1 = elem_txt
                    else:
                        prefijo = ''
                        if elem_txt and ' ' in elem_txt:
                            prefijo = elem_txt.rsplit(' ', 1)[0].strip()
                        header_l1 = ('{} {}'.format(prefijo, tname)).strip() if prefijo else tname
                        if elem_txt:
                            log.append('AVISO {}: las barras traen ELEMENTO_TBL "{}", que no corresponde a este assembly; se usa "{}" como encabezado.'.format(tname, elem_txt, header_l1))

                    # Lo unico que se escribe: el filtro de la lamina, los dos encabezados de
                    # agrupacion y el multiplicador de assemblies que usan las formulas.
                    # Ningun valor de la tabla se precalcula -- todos son campos nativos o
                    # formulas que resuelve Revit.
                    for r in barras:
                        escribir(r, guid_sheet_arm[0], sheet_number)
                        escribir(r, guids_arm['ARM_L1'], header_l1)
                        escribir(r, guids_arm['ARM_L2'], cant_str)
                        escribir_int(r, guids_arm[NOMBRE_CANT_ASSY], cant_assembly)
                        marcadas += 1

                # --- crear / reconfigurar la tabla del sheet ---
                nombre_schedule = PREFIJO_SCHEDULE + sheet_number
                sched_existente = next(
                    (doc.GetElement(ssi.ScheduleId) for ssi in existing_sheet_instances.get(sh.Id.Value, [])
                     if doc.GetElement(ssi.ScheduleId) is not None
                     and elem_name(doc.GetElement(ssi.ScheduleId)) == nombre_schedule),
                    None)

                # si existe con este nombre pero de otra categoria (version anterior:
                # multi-categoria), borrarla: la categoria de un schedule no se cambia.
                candidato = sched_existente or existing_schedules.get(nombre_schedule)
                if candidato is not None and candidato.Definition.CategoryId != REBAR_CAT_ID:
                    doc.Delete(candidato.Id)
                    existing_schedules.pop(nombre_schedule, None)
                    sched_existente = None
                    candidato = None
                    log.append('AVISO: se recreo la tabla del sheet {} (era de otra categoria).'.format(sheet_number))

                if sched_existente is not None:
                    configurar_schedule(sched_existente, sheet_number)
                    ya_estaban += 1
                    continue

                sched = existing_schedules.get(nombre_schedule)
                if sched is None:
                    sched = ViewSchedule.CreateSchedule(doc, REBAR_CAT_ID)
                    sched.Name = nombre_schedule
                    existing_schedules[nombre_schedule] = sched
                if not configurar_schedule(sched, sheet_number):
                    continue

                x0, y0, x1, y1 = usable_rect(sh)
                punto = XYZ(x1, y1, 0.0)
                try:
                    ScheduleSheetInstance.Create(doc, sh.Id, sched.Id, punto)
                    creados += 1
                    log.append('OK: tabla de armaduras creada en sheet {} ({} tipos).'.format(sheet_number, len(tipos)))
                except Exception as e:
                    log.append('ERROR colocando la tabla en sheet {}: {}'.format(sheet_number, e))
        finally:
            TransactionManager.Instance.TransactionTaskDone()

        log.insert(0, 'Tablas creadas: {} | ya existian: {} | barras marcadas: {} | SHEET_ARMADURAS limpiados: {}'.format(
            creados, ya_estaban, marcadas, limpiados))
        log.insert(1, 'Template aplicado: "{}" (de ahi salen las columnas y las formulas).'.format(template_nombre))
        OUT = log
# ----------------------------------------
log = Watch(py_tabla_de_assemblies_por_sheet)  # graph output
